# Grasshopper definition GA_02.gh (Grasshopper 1.0.7)

ghpython_script = GhPythonScript(Toggle=Toggle(True))  # -> out, resultado
# ---------- ghpython_script: Python ----------
__author__ = "Renato Godoi da Cruz"
__version__ = "2020.08.20"


import rhinoscriptsyntax as rs

from random import random, randint

class Parameter():
    """No Grasshopper, todo paamêtro tem 1 nome e um valor que vai de um min até um max."""
    def __init__(self, name, minimum, maximum):    #o valor entra nesse algoritmo
        self.name = name                         #parametro nome. Ex.: largura
        self.minimum = minimum                     #parametro min. Ex.: 1
        self.maximum = maximum                     #parametro max. Ex.: 10

#o cromossomo (str) será o conjuntos dos valores (escolhidos entre o min e o max)
#o individuo será o próprio cromossomo
class Individuo():
    """Definição"""
    def __init__(self, minimums, maximums, geracao=0):
        self.minimums = minimums
        self.maximums = maximums
        self.nota_avaliacao = 0
        self.geracao = geracao
        self.cromossomo = []                     #valores entre min e max dos parametros

        for i in range(len(lista_parametros)):   #escolher valores entre min e max aleatoriamente
            if (type(minimums[i]) == float) and (type(maximums[i]) == float):
                self.cromossomo.append(random.uniform(minimums[i], maximums[i])) #instance
            else:
                self.cromossomo.append(randint(minimums[i], maximums[i])) 

    def avaliacao(self):
        """Função fitness"""
        #Aqui deve receber o valor_objetivo de cada individuo (vem do modelo) Por exemplo, relação área/volume
        nota =randint(1000, 2222) #função provisório para continuar o desenv. script
        self.nota_avaliacao = nota

    def crossover(self, outro_individuo):
        """Determina o ponto de crossover"""
        corte = int(round(random()  * len(self.cromossomo))) #um número randômico (0 ou 1) vai multiplicar pelo tamanho do cromossomo (round é para arredondar)

        
        filho1 = outro_individuo.cromossomo[0:corte] + self.cromossomo[corte::]  #o filho recebe parte do cromossomo (de 0 até corte) do outro indíviduo
        filho2 = self.cromossomo[0:corte] + outro_individuo.cromossomo[corte::]  #o outro_ind é o individuo2 

        filhos = [Individuo(self.minimums, self.maximums, self.geracao + 1),
                  Individuo(self.minimums, self.maximums, self.geracao + 1)]
        filhos[0].cromossomo = filho1   #filho 1 e 2 na verdade está criando cromossomos
        filhos[1].cromossomo = filho2
        return filhos

    def mutacao(self, taxa_mutacao):
        """Determina a mutação dos cromossomos""" 
        for i in range(len(self.cromossomo)):
            if random() < taxa_mutacao:
                if (type(minimums[i]) == float) and (type(maximums[i]) == float):
                    self.cromossomo[i] = random.uniform(minimums[i], maximums[i]) #instance
                else:
                    self.cromossomo[i] = randint(minimums[i], maximums[i]) 
        return self

class AlgoritmoGenetico():
    def __init__(self, tamanho_populacao):
        self.tamanho_populacao = tamanho_populacao
        self.populacao = []
        self.geracao = 0
        self.melhor_solucao = 0

    def inicializa_populacao(self, minimums, maximums):
        for i in range(self.tamanho_populacao):
            self.populacao.append(Individuo(minimums, maximums))
        self.melhor_solucao = self.populacao[0] 

    def ordena_populacao(self):
        #AQUI DEVE ENTRAR SE É MINIMIZAÇÃO OU MAXIMIZAÇÃO
        self.populacao = sorted(self.populacao,
                                key = lambda populacao: populacao.nota_avaliacao,
                                reverse = True) 
        """
        self.populacao = sorted(self.populacao,
                                key = lambda populacao: populacao.nota_avaliacao)
        """

        #HÁ ALTERAÇÃO NOS VALORES, MAS AINDA NÃO ENTENDO SE ESTÁ BOM OU NÃO :/
        #AINDA A MELHOR SOLUÇÃO NÃO É O MENOR NÚMERO




    def melhor_individuo(self, individuo):
        if individuo.nota_avaliacao > self.melhor_solucao.nota_avaliacao:
            self.melhor_solucao = individuo

    def soma_avaliacoes(self):
        soma = 0
        for individuo in self.populacao:
            soma += individuo.nota_avaliacao
        return soma

    def seleciona_pai(self, soma_avaliacao):
        """Seleção dos indivíduos - método Roleta Viciada"""
        pai = -1
        valor_sorteado = random() * soma_avaliacao
        soma = 0
        i = 0
        while i < len(self.populacao) and soma < valor_sorteado:
            soma += self.populacao[i].nota_avaliacao
            pai += 1
            i += 1
        return pai


#AQUI PRECISA SAÍR COMO INPUT E NÃO COMO IMPRESSÃO

    def visualiza_geracao(self): #DADOS DO GA(raspar para uma planilha Excel)
        melhor = self.populacao[0]
        saida = melhor.cromossomo
        print(saida) #COMO FAZER ISSO SAIR POR OUTPUT?????
        return saida
        #print("G:%s --> Valor: %s Cromossomo: %s" % (self.populacao[0].geracao,
                                                     #melhor.nota_avaliacao,
                                                     #melhor.cromossomo))

#ACIMA TAMBÉM DEVE SER O RASPADOR DE DADOS


    def resolver(self, taxa_mutacao, numero_geracao):
        self.inicializa_populacao(minimums, maximums)

        for individuo in self.populacao:                #primeira geração (aleatória)
            individuo.avaliacao()

        self.ordena_populacao()
        self.visualiza_geracao()

        for geracao in range(numero_geracao):           #gerações novas
            soma_avaliacao = self.soma_avaliacoes()
            nova_populacao = []

            for individuos_gerados in range(0, self.tamanho_populacao, 2):
                pai1 = self.seleciona_pai(soma_avaliacao)
                pai2 = self.seleciona_pai(soma_avaliacao)

                filhos = self.populacao[pai1].crossover(self.populacao[pai2])

                nova_populacao.append(filhos[0].mutacao(taxa_mutacao))
                nova_populacao.append(filhos[1].mutacao(taxa_mutacao))

            self.populacao = list(nova_populacao)

            for individuo in self.populacao:
                individuo.avaliacao()

            self.ordena_populacao()
            self.visualiza_geracao()

            melhor = self.populacao[0]
            self.melhor_individuo(melhor)
        
        print("\nMelhor solução -> G: %s Valor: %s Cromossomo: %s" %
              (self.melhor_solucao.geracao,
               self.melhor_solucao.nota_avaliacao,
               self.melhor_solucao.cromossomo))
        
        return self.melhor_solucao.cromossomo


if Toggle: #método __main__

    lista_parametros = []
    lista_parametros.append(Parameter('Altura', 1, 5))
    lista_parametros.append(Parameter('Largura', 6, 10))
    lista_parametros.append(Parameter('Profundidade', 11, 20))
    #for parametro in lista_parametros:
        #print(parametro.nome)

    minimums = []
    maximums = []
    nomes = []
    for parametro in lista_parametros:       
        minimums.append(parametro.minimum)
        maximums.append(parametro.maximum)
        nomes.append(parametro.name)

    tamanho_populacao = 20
    taxa_mutacao = 0.05
    numero_geracao = 100
    ag = AlgoritmoGenetico(tamanho_populacao)

    #saida_inputs =           #AQUI DEVE INICILIZAR INPUTS PARA "EXPLODE TREE" PARA LIGAR AO MODELO
    #FUNÇÃO PARECIDA COM 'RESOLVER' OU BUSCAR NO 'INICILIZA' POPULAÇÃO, PARTE ALEATÓRIA

    #tipo um inicia = ag.saída #uma função para inicializar apenas um individuo para explodir as saídas

    resultado = ag.resolver(taxa_mutacao, numero_geracao)
# ---------- end ghpython_script ----------
ghpython_script_2 = GhPythonScript()  # -> out, a
# ---------- ghpython_script_2: Python ----------
__author__ = "Renato"
__version__ = "2020.09.09"

import rhinoscriptsyntax as rs
"""
a = []

for i in range(0,2):
    for j in range(0,3):
        a.append([i,j])

print a
"""


a = []

for i in range(5):
    a.append(i)

print a
# ---------- end ghpython_script_2 ----------
data_recorder = DataRecorder(ghpython_script_2.a, DataLimit=-10, RecordData=True)
data_recorder_2 = DataRecorder(ghpython_script.resultado, DataLimit=-10, RecordData=True)
panel = Panel(ghpython_script_2.out)
panel_2 = Panel(ghpython_script.out)
param_viewer = ParamViewer(ghpython_script.resultado)
panel_3 = Panel(data_recorder_2)
panel_4 = Panel(data_recorder)
