# Grasshopper definition GA_generico.gh (Grasshopper 1.0.7)

panel = Panel("optimum")

# ---- group: Launcher
toggle = BooleanToggle(True)

# ----
ghpython_script = GhPythonScript()  # -> out, line2
# ---------- ghpython_script: Python ----------
__author__ = "Renato"
__version__ = "2020.08.26"

import rhinoscriptsyntax as rs

def line():
    
    line1 = rs.AddLine((0,0,0),(1,1,1))
    return line1


line2 = line()
# ---------- end ghpython_script ----------
line = Line(ghpython_script.line2)

# ---- group: acessando número entre max e min
python = PythonScript()  # -> out, a
# ---------- python: Python ----------
import random 

lista_parametros = ["largura", 2, 10]


if (type(lista_parametros[1]) == float) and (type(lista_parametros[2]) == float):
	print(type(lista_parametros[1]))
	print(random.uniform(lista_parametros[1], lista_parametros[2])) #para flot
else:
	print(type(lista_parametros[1]))
	print(random.randint(lista_parametros[1], lista_parametros[2])) #para int
# ---------- end python ----------

# ----
python_2 = PythonScript(Toggle=toggle)  # -> out, a
# ---------- python_2: Python ----------
"""
Created on Mon May 14 15:18 PM 2020
@author: Renato Godoi da Cruz
email: renatogcruz@hotmail.com
github: github.com/renatogcruz
"""

from random import random

class Parametro():
    """No Grasshopper, todo paamêtro tem 1 nome e um valor que vai de um min até um max."""
    def __init__(self, nome, minimo, maximo): #o valor entra nesse algoritmo
        self.nome = nome                      #parametro nome. Ex.: largura
        self.minimo = minimo                  #parametro min. Ex.: 1
        self.maximo = maximo                  #parametro max. Ex.: 10

"""
class Individuo():
    def __init__(self, valor, valores, geracao=0):
        self.valor = valor
        self.valores = valores               # valor é definido entre min e max
        self.nota_avaliacao = 0              # a nota_avaliação será o valor_objetivo_ind
        self.geracao = geracao               # 
        self.cromossomo = []                 # cromossomo é igual valores
        
#precisa dar um for para juntar os valores (lista_parametros) no cromossomo (tipo, individuo 01 tem 2 de altura, 3 de largura e 4 de profundidade)
        if (type(lista_parametros[1]) == float) and (type(lista_parametros[2]) == float):
            print(type(lista_parametros[1]))
            self.valor.append(random.uniform(lista_parametros[1], lista_parametros[2]))
            print(self.valor) #para flot
        else:
            print(type(lista_parametros[1]))
            self.valor.append(random.randint(lista_parametros[1], lista_parametros[2]))
            print(self.valor) #para int
"""

if Toggle:

    lista_parametros = []
    lista_parametros.append(Parametro('Altura', 1, 5))
    lista_parametros.append(Parametro('Largura', 2, 10))
    lista_parametros.append(Parametro('Profundidade', 4, 20))
    for parametro in lista_parametros:
        print(parametro.nome)
        print(parametro.minimo)
        print(parametro. maximo)
# ---------- end python_2 ----------
python_3 = PythonScript(Toggle=toggle)  # -> out, a
# ---------- python_3: Python ----------
"""
Created on Mon May 14 15:18 PM 2020
@author: Renato Godoi da Cruz
email: renatogcruz@hotmail.com
github: github.com/renatogcruz
"""

from random import random

class Parametro():
    """No Grasshopper, todo paamêtro tem 1 nome e um valor que vai de um min até um max."""
    def __init__(self, nome, minimo, maximo):    #o valor entra nesse algoritmo
        self.nome = nome                         #parametro nome. Ex.: largura
        self.minimo = minimo                     #parametro min. Ex.: 1
        self.maximo = maximo                     #parametro max. Ex.: 10

#o cromossomo (str) será o conjuntos dos valores (escolhidos entre o min e o max)
#o individuo será o próprio cromossomo
class Individuo():
    """Definição"""
    def __init__(self, minimos, maximos, geracao=0):
        self.minimos = minimos
        self.maximos = maximos
        self.nota_avaliacao = 0
        self.geracao = geracao
        self.cromossomo = []                     #valores entre min e max dos parametros
        
        #escolher valores entre min e max aleatoriamente
        for i in range(len(lista_parametros)):
            self.cromossomo.append("testando")


if Toggle:

    lista_parametros = []
    lista_parametros.append(Parametro('Altura', 1, 5))
    lista_parametros.append(Parametro('Largura', 2, 10))
    lista_parametros.append(Parametro('Profundidade', 4, 20))
    #for parametro in lista_parametros:
        #print(parametro.nome)
    
    minimos = []
    maximos = []
    nomes = []
    for parametro in lista_parametros:
        minimos.append(parametro.minimo)
        maximos.append(parametro.maximo)
        nomes.append(parametro.nome)
    print(minimos)
    print(maximos)
    print(nomes)

    individuo1 = Individuo(minimos,  maximos)
    print("Mínimos = %s" % str(individuo1.minimos))
    print("Máximos = %s" % str(individuo1.maximos))
    print("Cromossomo = %s" % str(individuo1.cromossomo))
# ---------- end python_3 ----------
python_4 = PythonScript(Toggle=toggle)  # -> out, a
# ---------- python_4: Python ----------
"""
Created on Mon May 14 15:18 PM 2020
@author: Renato Godoi da Cruz
email: renatogcruz@hotmail.com
github: github.com/renatogcruz
"""

#from random import random
import random 

class Parametro():
    """No Grasshopper, todo paamêtro tem 1 nome e um valor que vai de um min até um max."""
    def __init__(self, nome, minimo, maximo):    #o valor entra nesse algoritmo
        self.nome = nome                         #parametro nome. Ex.: largura
        self.minimo = minimo                     #parametro min. Ex.: 1
        self.maximo = maximo                     #parametro max. Ex.: 10

#o cromossomo (str) será o conjuntos dos valores (escolhidos entre o min e o max)
#o individuo será o próprio cromossomo
class Individuo():
    """Definição"""
    def __init__(self, minimos, maximos, geracao=0):
        self.minimos = minimos
        self.maximos = maximos
        self.nota_avaliacao = 0
        self.geracao = geracao
        self.cromossomo = []                     #valores entre min e max dos parametros
        
        #escolher valores entre min e max aleatoriamente
        for i in range(len(lista_parametros)):
            if (type(lista_parametros[1]) == float) and (type(lista_parametros[2]) == float):
                self.cromossomo.append(1) #para flot
            else:
                self.cromossomo.append(0) #para int


if Toggle:

    lista_parametros = []
    lista_parametros.append(Parametro('Altura', 1, 5))
    lista_parametros.append(Parametro('Largura', 2, 10))
    lista_parametros.append(Parametro('Profundidade', 4, 20))
    #for parametro in lista_parametros:
        #print(parametro.nome)
    
    minimos = []
    maximos = []
    nomes = []
    for parametro in lista_parametros:
        minimos.append(parametro.minimo)
        maximos.append(parametro.maximo)
        nomes.append(parametro.nome)
    print(minimos)
    print(maximos)
    print(nomes)

    individuo1 = Individuo(minimos,  maximos)
    print("Mínimos = %s" % str(individuo1.minimos))
    print(type(minimos[0]))
    print("")
    print("Máximos = %s" % str(individuo1.maximos))
    print(type(maximos[0]))
    print("")
    print("Cromossomo = %s" % str(individuo1.cromossomo))
# ---------- end python_4 ----------
# Tarefas: 1 - definir se é maximizar ou minimizar
# 2 - criar a saída dos paramêtros para serem ligadas ao modelo. Deve ser gerado uma geração (para conter os valores entre mínimos e máximos). Depois o algoritmo deve ser rodado até o fim;
# 3 - construir a classe de raspagem de dados.
# 4 - decidir o que será input do GA (ex.: número de gerações, taxa de mutação, etc)
qual_nome = Panel("""1 - Solve
2 - Optimum
3 - Beagle""")
ghpython_script_2 = GhPythonScript(Toggle=toggle)  # -> out, graft(input)
# ---------- ghpython_script_2: Python ----------
__author__ = "Renato Godoi da Cruz"
__version__ = "2020.08.20"


import rhinoscriptsyntax as rs

from random import random, randint

class Parametro():
    """No Grasshopper, todo paamêtro tem 1 nome e um valor que vai de um min até um max."""
    def __init__(self, nome, minimo, maximo):    #o valor entra nesse algoritmo
        self.nome = nome                         #parametro nome. Ex.: largura
        self.minimo = minimo                     #parametro min. Ex.: 1
        self.maximo = maximo                     #parametro max. Ex.: 10

#o cromossomo (str) será o conjuntos dos valores (escolhidos entre o min e o max)
#o individuo será o próprio cromossomo
class Individuo():
    """Definição"""
    def __init__(self, minimos, maximos, geracao=0):
        self.minimos = minimos
        self.maximos = maximos
        self.nota_avaliacao = 0
        self.geracao = geracao
        self.cromossomo = []                     #valores entre min e max dos parametros

        for i in range(len(lista_parametros)):   #escolher valores entre min e max aleatoriamente
            if (type(minimos[i]) == float) and (type(maximos[i]) == float):
                self.cromossomo.append(random.uniform(minimos[i], maximos[i])) #instance
            else:
                self.cromossomo.append(randint(minimos[i], maximos[i])) 

    def avaliacao(self):
        """Função fitness"""
        #Aqui deve receber o valor_objetivo de cada individuo (vem do modelo) Por exemplo, relação área/volume
        nota =randint(1000, 2222) #função provisório para continuar o desenv. script
        self.nota_avaliacao = nota

    def crossover(self, outro_individuo):
        """Determina o ponto de crossover"""
        corte = int(round(random()  * len(self.cromossomo))) #um número randômico (0 ou 1) vai multiplicar pelo tamanho do cromossomo (round é para arredondar)

        
        filho1 = outro_individuo.cromossomo[0:corte] + self.cromossomo[corte::]  #o filho recebe parte do cromossomo (de 0 até corte) do outro indíviduo
        filho2 = self.cromossomo[0:corte] + outro_individuo.cromossomo[corte::]  #o outro_ind é o individuo2 

        filhos = [Individuo(self.minimos, self.maximos, self.geracao + 1),
                  Individuo(self.minimos, self.maximos, self.geracao + 1)]
        filhos[0].cromossomo = filho1   #filho 1 e 2 na verdade está criando cromossomos
        filhos[1].cromossomo = filho2
        return filhos

    def mutacao(self, taxa_mutacao):
        """Determina a mutação dos cromossomos""" 
        for i in range(len(self.cromossomo)):
            if random() < taxa_mutacao:
                if (type(minimos[i]) == float) and (type(maximos[i]) == float):
                    self.cromossomo[i] = random.uniform(minimos[i], maximos[i]) #instance
                else:
                    self.cromossomo[i] = randint(minimos[i], maximos[i]) 
        return self

class AlgoritmoGenetico():
    def __init__(self, tamanho_populacao):
        self.tamanho_populacao = tamanho_populacao
        self.populacao = []
        self.geracao = 0
        self.melhor_solucao = 0

    def inicializa_populacao(self, minimos, maximos):
        for i in range(self.tamanho_populacao):
            self.populacao.append(Individuo(minimos, maximos))
        self.melhor_solucao = self.populacao[0] 

    def ordena_populacao(self):
        #AQUI DEVE ENTRAR SE É MINIMIZAÇÃO OU MAXIMIZAÇÃO
        self.populacao = sorted(self.populacao,
                                key = lambda populacao: populacao.nota_avaliacao,
                                reverse = True) 
        """
        self.populacao = sorted(self.populacao,
                                key = lambda populacao: populacao.nota_avaliacao)
        """

        #HÁ ALTERAÇÃO NOS VALORES, MAS AINDA NÃO ENTENDO SE ESTÁ BOM OU NÃO :/
        #AINDA A MELHOR SOLUÇÃO NÃO É O MENOR NÚMERO




    def melhor_individuo(self, individuo):
        if individuo.nota_avaliacao > self.melhor_solucao.nota_avaliacao:
            self.melhor_solucao = individuo

    def soma_avaliacoes(self):
        soma = 0
        for individuo in self.populacao:
            soma += individuo.nota_avaliacao
        return soma

    def seleciona_pai(self, soma_avaliacao):
        """Seleção dos indivíduos - método Roleta Viciada"""
        pai = -1
        valor_sorteado = random() * soma_avaliacao
        soma = 0
        i = 0
        while i < len(self.populacao) and soma < valor_sorteado:
            soma += self.populacao[i].nota_avaliacao
            pai += 1
            i += 1
        return pai

    def visualiza_geracao(self): #DADOS DO GA(raspar para uma planilha Excel)
        melhor = self.populacao[0]
        print("G:%s --> Valor: %s Cromossomo: %s" % (self.populacao[0].geracao,
                                                     melhor.nota_avaliacao,
                                                     melhor.cromossomo))
    ########

if Toggle: #método __main__

    lista_parametros = []
    lista_parametros.append(Parametro('Altura', 1, 5))
    lista_parametros.append(Parametro('Largura', 6, 10))
    lista_parametros.append(Parametro('Profundidade', 11, 20))
    #for parametro in lista_parametros:
        #print(parametro.nome)

    minimos = []
    maximos = []
    nomes = []
    for parametro in lista_parametros:       
        minimos.append(parametro.minimo)
        maximos.append(parametro.maximo)
        nomes.append(parametro.nome)

    tamanho_populacao = 20
    taxa_mutacao = 0.05
    numero_geracao = 100

    ag = AlgoritmoGenetico(tamanho_populacao)
    ag.inicializa_populacao(minimos, maximos)

#INICIALIZA E EXPLODE CROMOSSOMOS
    #a = ag.populacao[1].cromossomo
    #input = a
    #print("Crom 1 = %s" % a)

#CONTINUA O GA
    for i in range(ag.tamanho_populacao):
        #Aqui está funcionandoooooooooo
        b = ag.populacao[i].cromossomo
        input = b
        print("Crom. %s = %s" % (i, b))
        #Termina aquiiiiiiiiiiiiiiiiiii
# ---------- end ghpython_script_2 ----------

# ---- group: está buscando, mas vem como "instance"
python_5 = PythonScript()  # -> out, a; same code as python
python_6 = PythonScript(Toggle=toggle)  # -> out, a
# ---------- python_6: Python ----------
"""
Created on Mon May 14 15:18 PM 2020
@author: Renato Godoi da Cruz
email: renatogcruz@hotmail.com
github: github.com/renatogcruz
"""

#from random import random
import random 

class Parametro():
    """No Grasshopper, todo paamêtro tem 1 nome e um valor que vai de um min até um max."""
    def __init__(self, nome, minimo, maximo):    #o valor entra nesse algoritmo
        self.nome = nome                         #parametro nome. Ex.: largura
        self.minimo = minimo                     #parametro min. Ex.: 1
        self.maximo = maximo                     #parametro max. Ex.: 10

#o cromossomo (str) será o conjuntos dos valores (escolhidos entre o min e o max)
#o individuo será o próprio cromossomo
class Individuo():
    """Definição"""
    def __init__(self, minimos, maximos, geracao=0):
        self.minimos = minimos
        self.maximos = maximos
        self.nota_avaliacao = 0
        self.geracao = geracao
        self.cromossomo = []                     #valores entre min e max dos parametros
        
        #escolher valores entre min e max aleatoriamente
        for i in range(len(lista_parametros)):
            if (type(lista_parametros[1]) == float) and (type(lista_parametros[2]) == float):
                valor = type(lista_parametros[1])
                self.cromossomo.append(valor) #instance
                #print(random.uniform(lista_parametros[1], lista_parametros[2])) #para flot
            else:
                valor = type(lista_parametros[1])
                self.cromossomo.append(valor) #instance
                #print(random.randint(lista_parametros[1], lista_parametros[2])) #para int




if Toggle:

    lista_parametros = []
    lista_parametros.append(Parametro('Altura', 1, 5))
    lista_parametros.append(Parametro('Largura', 2, 10))
    lista_parametros.append(Parametro('Profundidade', 4, 20))
    #for parametro in lista_parametros:
        #print(parametro.nome)
    
    minimos = []
    maximos = []
    nomes = []
    for parametro in lista_parametros:
        minimos.append(parametro.minimo)
        maximos.append(parametro.maximo)
        nomes.append(parametro.nome)
    print(minimos)
    print(maximos)
    print(nomes)

    individuo1 = Individuo(minimos,  maximos)
    print("Mínimos = %s" % str(individuo1.minimos))
    print(type(minimos[0]))
    print("")
    print("Máximos = %s" % str(individuo1.maximos))
    print(type(maximos[0]))
    print("")
    print("Cromossomo = %s" % str(individuo1.cromossomo))
# ---------- end python_6 ----------

# ----
python_7 = PythonScript(Toggle=toggle)  # -> out, a
# ---------- python_7: Python ----------
"""
Created on Mon May 14 15:18 PM 2020
@author: Renato Godoi da Cruz
email: renatogcruz@hotmail.com
github: github.com/renatogcruz
"""

#from random import random
import random 

class Parametro():
    """No Grasshopper, todo paamêtro tem 1 nome e um valor que vai de um min até um max."""
    def __init__(self, nome, minimo, maximo):    #o valor entra nesse algoritmo
        self.nome = nome                         #parametro nome. Ex.: largura
        self.minimo = minimo                     #parametro min. Ex.: 1
        self.maximo = maximo                     #parametro max. Ex.: 10

#o cromossomo (str) será o conjuntos dos valores (escolhidos entre o min e o max)
#o individuo será o próprio cromossomo
class Individuo():
    """Definição"""
    def __init__(self, minimos, maximos, geracao=0):
        self.minimos = minimos
        self.maximos = maximos
        self.nota_avaliacao = 0
        self.geracao = geracao
        self.cromossomo = []                     #valores entre min e max dos parametros
        
        #escolher valores entre min e max aleatoriamente
        for i in range(len(lista_parametros)):
            if (type(minimos[1]) == float) and (type(maximos[2]) == float):
                #valor = type(minimos[1])
                self.cromossomo.append(random.uniform(minimos[1], maximos[2])) #instance
                #print(random.uniform(lista_parametros[1], lista_parametros[2])) #para flot
            else:
                #valor = type(maximos[1])
                self.cromossomo.append(random.randint(minimos[1], maximos[2])) #instance
                #print(random.randint(lista_parametros[1], lista_parametros[2])) #para int

if Toggle:

    lista_parametros = []
    lista_parametros.append(Parametro('Altura', 1, 5))
    lista_parametros.append(Parametro('Largura', 2, 10))
    lista_parametros.append(Parametro('Profundidade', 4, 20))
    #for parametro in lista_parametros:
        #print(parametro.nome)
    
    minimos = []
    maximos = []
    nomes = []
    for parametro in lista_parametros:
        minimos.append(parametro.minimo)
        maximos.append(parametro.maximo)
        nomes.append(parametro.nome)
    print(minimos)
    print(maximos)
    print(nomes)

    individuo1 = Individuo(minimos,  maximos)
    print("Mínimos = %s" % str(individuo1.minimos))
    print("Máximos = %s" % str(individuo1.maximos))
    print("Cromossomo = %s" % str(individuo1.cromossomo))
# ---------- end python_7 ----------
ghpython_script_3 = GhPythonScript(Toggle=toggle)  # -> out, graft(input)
# ---------- ghpython_script_3: Python ----------
__author__ = "Renato Godoi da Cruz"
__version__ = "2020.08.20"


import rhinoscriptsyntax as rs

from random import random, randint

class Parametro():
    """No Grasshopper, todo paamêtro tem 1 nome e um valor que vai de um min até um max."""
    def __init__(self, nome, minimo, maximo):    #o valor entra nesse algoritmo
        self.nome = nome                         #parametro nome. Ex.: largura
        self.minimo = minimo                     #parametro min. Ex.: 1
        self.maximo = maximo                     #parametro max. Ex.: 10

#o cromossomo (str) será o conjuntos dos valores (escolhidos entre o min e o max)
#o individuo será o próprio cromossomo
class Individuo():
    """Definição"""
    def __init__(self, minimos, maximos, geracao=0):
        self.minimos = minimos
        self.maximos = maximos
        self.nota_avaliacao = 0
        self.geracao = geracao
        self.cromossomo = []                     #valores entre min e max dos parametros

        for i in range(len(lista_parametros)):   #escolher valores entre min e max aleatoriamente
            if (type(minimos[i]) == float) and (type(maximos[i]) == float):
                self.cromossomo.append(random.uniform(minimos[i], maximos[i])) #instance
            else:
                self.cromossomo.append(randint(minimos[i], maximos[i])) 

    def avaliacao(self):
        """Função fitness"""
        #Aqui deve receber o valor_objetivo de cada individuo (vem do modelo) Por exemplo, relação área/volume
        nota =randint(1000, 2222) #função provisório para continuar o desenv. script
        self.nota_avaliacao = nota

    def crossover(self, outro_individuo):
        """Determina o ponto de crossover"""
        corte = int(round(random()  * len(self.cromossomo))) #um número randômico (0 ou 1) vai multiplicar pelo tamanho do cromossomo (round é para arredondar)

        
        filho1 = outro_individuo.cromossomo[0:corte] + self.cromossomo[corte::]  #o filho recebe parte do cromossomo (de 0 até corte) do outro indíviduo
        filho2 = self.cromossomo[0:corte] + outro_individuo.cromossomo[corte::]  #o outro_ind é o individuo2 

        filhos = [Individuo(self.minimos, self.maximos, self.geracao + 1),
                  Individuo(self.minimos, self.maximos, self.geracao + 1)]
        filhos[0].cromossomo = filho1   #filho 1 e 2 na verdade está criando cromossomos
        filhos[1].cromossomo = filho2
        return filhos

    def mutacao(self, taxa_mutacao):
        """Determina a mutação dos cromossomos""" 
        for i in range(len(self.cromossomo)):
            if random() < taxa_mutacao:
                if (type(minimos[i]) == float) and (type(maximos[i]) == float):
                    self.cromossomo[i] = random.uniform(minimos[i], maximos[i]) #instance
                else:
                    self.cromossomo[i] = randint(minimos[i], maximos[i]) 
        return self

class AlgoritmoGenetico():
    def __init__(self, tamanho_populacao):
        self.tamanho_populacao = tamanho_populacao
        self.populacao = []
        self.geracao = 0
        self.melhor_solucao = 0

    def inicializa_populacao(self, minimos, maximos):
        for i in range(self.tamanho_populacao):
            self.populacao.append(Individuo(minimos, maximos))
        self.melhor_solucao = self.populacao[0] 

    def ordena_populacao(self):
        #AQUI DEVE ENTRAR SE É MINIMIZAÇÃO OU MAXIMIZAÇÃO
        self.populacao = sorted(self.populacao,
                                key = lambda populacao: populacao.nota_avaliacao,
                                reverse = True) 
        """
        self.populacao = sorted(self.populacao,
                                key = lambda populacao: populacao.nota_avaliacao)
        """

        #HÁ ALTERAÇÃO NOS VALORES, MAS AINDA NÃO ENTENDO SE ESTÁ BOM OU NÃO :/
        #AINDA A MELHOR SOLUÇÃO NÃO É O MENOR NÚMERO




    def melhor_individuo(self, individuo):
        if individuo.nota_avaliacao > self.melhor_solucao.nota_avaliacao:
            self.melhor_solucao = individuo

    def soma_avaliacoes(self):
        soma = 0
        for individuo in self.populacao:
            soma += individuo.nota_avaliacao
        return soma

    def seleciona_pai(self, soma_avaliacao):
        """Seleção dos indivíduos - método Roleta Viciada"""
        pai = -1
        valor_sorteado = random() * soma_avaliacao
        soma = 0
        i = 0
        while i < len(self.populacao) and soma < valor_sorteado:
            soma += self.populacao[i].nota_avaliacao
            pai += 1
            i += 1
        return pai

    def visualiza_geracao(self): #DADOS DO GA(raspar para uma planilha Excel)
        melhor = self.populacao[0]
        print("G:%s --> Valor: %s Cromossomo: %s" % (self.populacao[0].geracao,
                                                     melhor.nota_avaliacao,
                                                     melhor.cromossomo))


    def resolver(self, taxa_mutacao, numero_geracao):
        self.inicializa_populacao(minimos, maximos)

        for individuo in self.populacao:                #primeira geração (aleatória)
            individuo.avaliacao()

        self.ordena_populacao()
        self.visualiza_geracao()

        for geracao in range(numero_geracao):           #gerações novas
            soma_avaliacao = self.soma_avaliacoes()
            nova_populacao = []

            for individuos_gerados in range(0, self.tamanho_populacao, 2):
                pai1 = self.seleciona_pai(soma_avaliacao)
                pai2 = self.seleciona_pai(soma_avaliacao)

                filhos = self.populacao[pai1].crossover(self.populacao[pai2])

                nova_populacao.append(filhos[0].mutacao(taxa_mutacao))
                nova_populacao.append(filhos[1].mutacao(taxa_mutacao))

            self.populacao = list(nova_populacao)

            for individuo in self.populacao:
                individuo.avaliacao()

            self.ordena_populacao()
            self.visualiza_geracao()

            melhor = self.populacao[0]
            self.melhor_individuo(melhor)
        
        print("\nMelhor solução -> G: %s Valor: %s Cromossomo: %s" %
              (self.melhor_solucao.geracao,
               self.melhor_solucao.nota_avaliacao,
               self.melhor_solucao.cromossomo))
        
        return self.melhor_solucao.cromossomo


if Toggle: #método __main__

    lista_parametros = []
    lista_parametros.append(Parametro('Altura', 1, 5))
    lista_parametros.append(Parametro('Largura', 6, 10))
    lista_parametros.append(Parametro('Profundidade', 11, 20))
    #for parametro in lista_parametros:
        #print(parametro.nome)

    minimos = []
    maximos = []
    nomes = []
    for parametro in lista_parametros:       
        minimos.append(parametro.minimo)
        maximos.append(parametro.maximo)
        nomes.append(parametro.nome)

    tamanho_populacao = 20
    taxa_mutacao = 0.05
    numero_geracao = 100
    ag = AlgoritmoGenetico(tamanho_populacao)
    ag.inicializa_populacao(minimos, maximos)



    
    a = ag.populacao[1].cromossomo
    input = a
    print("Crom 1 = %s" % a)
"""
    for i in range(ag.tamanho_populacao):

        #Aqui está funcionandoooooooooo
        b = ag.populacao[i].cromossomo
        input = b
        print("Crom. %s = %s" % (i, b))
        #Termina aquiiiiiiiiiiiiiiiiiii
"""
# ---------- end ghpython_script_3 ----------
ghpython_script_4 = GhPythonScript(Toggle=toggle)  # -> out, a
# ---------- ghpython_script_4: Python ----------
__author__ = "Renato"
__version__ = "2020.08.20"


import rhinoscriptsyntax as rs

#from random import random
import random 

class Parametro():
    """No Grasshopper, todo paamêtro tem 1 nome e um valor que vai de um min até um max."""
    def __init__(self, nome, minimo, maximo):    #o valor entra nesse algoritmo
        self.nome = nome                         #parametro nome. Ex.: largura
        self.minimo = minimo                     #parametro min. Ex.: 1
        self.maximo = maximo                     #parametro max. Ex.: 10

#o cromossomo (str) será o conjuntos dos valores (escolhidos entre o min e o max)
#o individuo será o próprio cromossomo
class Individuo():
    """Definição"""
    def __init__(self, minimos, maximos, geracao=0):
        self.minimos = minimos
        self.maximos = maximos
        self.nota_avaliacao = 0
        self.geracao = geracao
        self.cromossomo = []                     #valores entre min e max dos parametros
        
        for i in range(len(lista_parametros)):   #escolher valores entre min e max aleatoriamente
            if (type(minimos[i]) == float) and (type(maximos[i]) == float):
                self.cromossomo.append(random.uniform(minimos[i], maximos[i])) #instance
            else:
                self.cromossomo.append(random.randint(minimos[i], maximos[i])) 
    
    def avaliacao(self):
        """Função fitness"""
        #Aqui deve receber o valor_objetivo de cada individuo (vem do modelo) Por exemplo, relação área/volume
        nota =random.randint(2000, 2222) #função provisório para continuar o desenv. script
        self.nota_avaliacao = nota


if Toggle:

    lista_parametros = []
    lista_parametros.append(Parametro('Altura', 1, 5))
    lista_parametros.append(Parametro('Largura', 6, 10))
    lista_parametros.append(Parametro('Profundidade', 11, 20))
    #for parametro in lista_parametros:
        #print(parametro.nome)
    
    minimos = []
    maximos = []
    nomes = []
    for parametro in lista_parametros:
        minimos.append(parametro.minimo)
        maximos.append(parametro.maximo)
        nomes.append(parametro.nome)
    print(minimos)
    print(maximos)
    print(nomes)

    individuo1 = Individuo(minimos,  maximos)
    print("Mínimos = %s" % str(individuo1.minimos))
    print("Máximos = %s" % str(individuo1.maximos))
    print("Cromossomo = %s" % str(individuo1.cromossomo))
    
    individuo1.avaliacao()
    print("Nota = %s" %individuo1.nota_avaliacao)
# ---------- end ghpython_script_4 ----------
ghpython_script_5 = GhPythonScript(Toggle=toggle)  # -> out, a
# ---------- ghpython_script_5: Python ----------
__author__ = "Renato Godoi da Cruz"
__version__ = "2020.08.20"


import rhinoscriptsyntax as rs

from random import random, randint

class Parametro():
    """No Grasshopper, todo paamêtro tem 1 nome e um valor que vai de um min até um max."""
    def __init__(self, nome, minimo, maximo):    #o valor entra nesse algoritmo
        self.nome = nome                         #parametro nome. Ex.: largura
        self.minimo = minimo                     #parametro min. Ex.: 1
        self.maximo = maximo                     #parametro max. Ex.: 10

#o cromossomo (str) será o conjuntos dos valores (escolhidos entre o min e o max)
#o individuo será o próprio cromossomo
class Individuo():
    """Definição"""
    def __init__(self, minimos, maximos, geracao=0):
        self.minimos = minimos
        self.maximos = maximos
        self.nota_avaliacao = 0
        self.geracao = geracao
        self.cromossomo = []                     #valores entre min e max dos parametros

        for i in range(len(lista_parametros)):   #escolher valores entre min e max aleatoriamente
            if (type(minimos[i]) == float) and (type(maximos[i]) == float):
                self.cromossomo.append(random.uniform(minimos[i], maximos[i])) #instance
            else:
                self.cromossomo.append(randint(minimos[i], maximos[i])) 

    def avaliacao(self):
        """Função fitness"""
        #Aqui deve receber o valor_objetivo de cada individuo (vem do modelo) Por exemplo, relação área/volume
        nota =randint(1000, 2222) #função provisório para continuar o desenv. script
        self.nota_avaliacao = nota

    def crossover(self, outro_individuo):
        """Determina o ponto de crossover"""
        corte = int(round(random()  * len(self.cromossomo))) #um número randômico (0 ou 1) vai multiplicar pelo tamanho do cromossomo (round é para arredondar)

        
        filho1 = outro_individuo.cromossomo[0:corte] + self.cromossomo[corte::]  #o filho recebe parte do cromossomo (de 0 até corte) do outro indíviduo
        filho2 = self.cromossomo[0:corte] + outro_individuo.cromossomo[corte::]  #o outro_ind é o individuo2 

        filhos = [Individuo(self.minimos, self.maximos, self.geracao + 1),
                  Individuo(self.minimos, self.maximos, self.geracao + 1)]
        filhos[0].cromossomo = filho1   #filho 1 e 2 na verdade está criando cromossomos
        filhos[1].cromossomo = filho2
        return filhos

    def mutacao(self, taxa_mutacao):
        """Determina a mutação dos cromossomos""" 
        print("Antes %s" % self.cromossomo)
        for i in range(len(self.cromossomo)):
            if random() < taxa_mutacao:
                if (type(minimos[i]) == float) and (type(maximos[i]) == float):
                    self.cromossomo[i] = random.uniform(minimos[i], maximos[i]) #instance
                else:
                    self.cromossomo[i] = randint(minimos[i], maximos[i]) 
        print("Depois %s" % self.cromossomo)
        return self

class AlgoritmoGenetico():
    def __init__(self, tamanho_populacao):
        self.tamanho_populacao = tamanho_populacao
        self.populacao = []
        self.geracao = 0
        self.melhor_solucao = 0

    def inicializa_populacao(self, minimos, maximos):
        for i in range(self.tamanho_populacao):
            self.populacao.append(Individuo(minimos, maximos))
        self.melhor_solucao = self.populacao[0] 

    def ordena_populacao(self):
        #AQUI DEVE ENTRAR SE É MINIMIZAÇÃO OU MAXIMIZAÇÃO
        self.populacao = sorted(self.populacao,
                                key = lambda populacao: populacao.nota_avaliacao,
                                reverse = True)

    def melhor_individuo(self, individuo):
        if individuo.nota_avaliacao > self.melhor_solucao.nota_avaliacao:
            self.melhor_solucao = individuo

    def soma_avaliacoes(self):
        soma = 0
        for individuo in self.populacao:
            soma += individuo.nota_avaliacao
        return soma

    def seleciona_pai(self, soma_avaliacao):
        """Seleção dos indivíduos - método Roleta Viciada"""
        pai = -1
        valor_sorteado = random() * soma_avaliacao
        soma = 0
        i = 0
        while i < len(self.populacao) and soma < valor_sorteado:
            soma += self.populacao[i].nota_avaliacao
            pai += 1
            i += 1
        return pai

if Toggle:

    lista_parametros = []
    lista_parametros.append(Parametro('Altura', 1, 5))
    lista_parametros.append(Parametro('Largura', 6, 10))
    lista_parametros.append(Parametro('Profundidade', 11, 20))
    #for parametro in lista_parametros:
        #print(parametro.nome)
    
    minimos = []
    maximos = []
    nomes = []
    for parametro in lista_parametros:       #primeira população
        minimos.append(parametro.minimo)
        maximos.append(parametro.maximo)
        nomes.append(parametro.nome)

    tamanho_populacao = 20
    taxa_mutacao = 0.05
    numero_geracao = 100

    ag = AlgoritmoGenetico(tamanho_populacao)
    ag.inicializa_populacao(minimos, maximos)
    for individuo in ag.populacao: 
        individuo.avaliacao()
    ag.ordena_populacao()
    ag.melhor_individuo(ag.populacao[0])
    soma = ag.soma_avaliacoes()

    nova_populacao = []                       #nova população
    probabilidade_mutacao = 0.01
    for individuos_gerados in range(0, ag.tamanho_populacao, 2):
        pai1 = ag.seleciona_pai(soma)
        pai2 = ag.seleciona_pai(soma)
        
        filhos = ag.populacao[pai1].crossover(ag.populacao[pai2])
        nova_populacao.append(filhos[0].mutacao(probabilidade_mutacao))
        nova_populacao.append(filhos[0].mutacao(probabilidade_mutacao))
    
    ag.populacao = list(nova_populacao)
    for individuo in ag.populacao:
        individuo.avaliacao()
    
    ag.ordena_populacao()
    ag.melhor_individuo(ag.populacao[0])
    soma = ag.soma_avaliacoes()
    
    print("Melhor = %s" % ag.melhor_solucao.cromossomo, "Nota = %s" % ag.melhor_solucao.nota_avaliacao)
# ---------- end ghpython_script_5 ----------
ghpython_script_6 = GhPythonScript(Toggle=toggle)  # -> out, a
# ---------- ghpython_script_6: Python ----------
__author__ = "Renato Godoi da Cruz"
__version__ = "2020.08.20"


import rhinoscriptsyntax as rs

from random import random, randint

class Parametro():
    """No Grasshopper, todo paamêtro tem 1 nome e um valor que vai de um min até um max."""
    def __init__(self, nome, minimo, maximo):    #o valor entra nesse algoritmo
        self.nome = nome                         #parametro nome. Ex.: largura
        self.minimo = minimo                     #parametro min. Ex.: 1
        self.maximo = maximo                     #parametro max. Ex.: 10

#o cromossomo (str) será o conjuntos dos valores (escolhidos entre o min e o max)
#o individuo será o próprio cromossomo
class Individuo():
    """Definição"""
    def __init__(self, minimos, maximos, geracao=0):
        self.minimos = minimos
        self.maximos = maximos
        self.nota_avaliacao = 0
        self.geracao = geracao
        self.cromossomo = []                     #valores entre min e max dos parametros
        
        for i in range(len(lista_parametros)):   #escolher valores entre min e max aleatoriamente
            if (type(minimos[i]) == float) and (type(maximos[i]) == float):
                self.cromossomo.append(random.uniform(minimos[i], maximos[i])) #instance
            else:
                self.cromossomo.append(randint(minimos[i], maximos[i])) 

    def avaliacao(self):
        """Função fitness"""
        #Aqui deve receber o valor_objetivo de cada individuo (vem do modelo) Por exemplo, relação área/volume
        nota =randint(2000, 2222) #função provisório para continuar o desenv. script
        self.nota_avaliacao = nota

    def crossover(self, outro_individuo):
        """Determina o ponto de crossover"""
        corte = int(round(random()  * len(self.cromossomo))) #um número randômico (0 ou 1) vai multiplicar pelo tamanho do cromossomo (round é para arredondar)

        
        filho1 = outro_individuo.cromossomo[0:corte] + self.cromossomo[corte::]  #o filho recebe parte do cromossomo (de 0 até corte) do outro indíviduo
        filho2 = self.cromossomo[0:corte] + outro_individuo.cromossomo[corte::]  #o outro_ind é o individuo2 
        
        filhos = [Individuo(self.minimos, self.maximos, self.geracao + 1),
                  Individuo(self.minimos, self.maximos, self.geracao + 1)]
        filhos[0].cromossomo = filho1   #filho 1 e 2 na verdade está criando cromossomos
        filhos[1].cromossomo = filho2
        return filhos

    def mutacao(self, taxa_mutacao):
        """Determina a mutação dos cromossomos""" 
        print("Antes %s" % self.cromossomo)
        for i in range(len(self.cromossomo)):
            if random() < taxa_mutacao:
                if (type(minimos[i]) == float) and (type(maximos[i]) == float):
                    self.cromossomo[i] = random.uniform(minimos[i], maximos[i]) #instance
                else:
                    self.cromossomo[i] = randint(minimos[i], maximos[i]) 
        print("Depois %s" % self.cromossomo)
        return self


if Toggle:

    lista_parametros = []
    lista_parametros.append(Parametro('Altura', 1, 5))
    lista_parametros.append(Parametro('Largura', 6, 10))
    lista_parametros.append(Parametro('Profundidade', 11, 20))
    #for parametro in lista_parametros:
        #print(parametro.nome)
    
    minimos = []
    maximos = []
    nomes = []
    for parametro in lista_parametros:
        minimos.append(parametro.minimo)
        maximos.append(parametro.maximo)
        nomes.append(parametro.nome)
    print(minimos)
    print(maximos)
    print(nomes)

    individuo1 = Individuo(minimos,  maximos)
    print("Individuo 1")
    individuo1.avaliacao()
    print("Nota = %s" %individuo1.nota_avaliacao)
    print("Cromossomo = %s" % str(individuo1.cromossomo))
    
    individuo2 = Individuo(minimos,  maximos)
    print("Individuo 2")
    individuo2.avaliacao()
    print("Nota = %s" %individuo2.nota_avaliacao)
    print("Cromossomo = %s" % str(individuo2.cromossomo))


    individuo1.crossover(individuo2)
    
    individuo1.mutacao(0.5)
    individuo2.mutacao(0.5)
# ---------- end ghpython_script_6 ----------
ghpython_script_7 = GhPythonScript(Toggle=toggle)  # -> out, input
# ---------- ghpython_script_7: Python ----------
__author__ = "Renato Godoi da Cruz"
__version__ = "2020.08.20"


import rhinoscriptsyntax as rs

from random import random, randint

class Parametro():
    """No Grasshopper, todo paamêtro tem 1 nome e um valor que vai de um min até um max."""
    def __init__(self, nome, minimo, maximo):    #o valor entra nesse algoritmo
        self.nome = nome                         #parametro nome. Ex.: largura
        self.minimo = minimo                     #parametro min. Ex.: 1
        self.maximo = maximo                     #parametro max. Ex.: 10

#o cromossomo (str) será o conjuntos dos valores (escolhidos entre o min e o max)
#o individuo será o próprio cromossomo
class Individuo():
    """Definição"""
    def __init__(self, minimos, maximos, geracao=0):
        self.minimos = minimos
        self.maximos = maximos
        self.nota_avaliacao = 0
        self.geracao = geracao
        self.cromossomo = []                     #valores entre min e max dos parametros

        for i in range(len(lista_parametros)):   #escolher valores entre min e max aleatoriamente
            if (type(minimos[i]) == float) and (type(maximos[i]) == float):
                self.cromossomo.append(random.uniform(minimos[i], maximos[i])) #instance
            else:
                self.cromossomo.append(randint(minimos[i], maximos[i])) 

    def avaliacao(self):
        """Função fitness"""
        #Aqui deve receber o valor_objetivo de cada individuo (vem do modelo) Por exemplo, relação área/volume
        nota =randint(1000, 2222) #função provisório para continuar o desenv. script
        self.nota_avaliacao = nota

    def crossover(self, outro_individuo):
        """Determina o ponto de crossover"""
        corte = int(round(random()  * len(self.cromossomo))) #um número randômico (0 ou 1) vai multiplicar pelo tamanho do cromossomo (round é para arredondar)

        
        filho1 = outro_individuo.cromossomo[0:corte] + self.cromossomo[corte::]  #o filho recebe parte do cromossomo (de 0 até corte) do outro indíviduo
        filho2 = self.cromossomo[0:corte] + outro_individuo.cromossomo[corte::]  #o outro_ind é o individuo2 

        filhos = [Individuo(self.minimos, self.maximos, self.geracao + 1),
                  Individuo(self.minimos, self.maximos, self.geracao + 1)]
        filhos[0].cromossomo = filho1   #filho 1 e 2 na verdade está criando cromossomos
        filhos[1].cromossomo = filho2
        return filhos

    def mutacao(self, taxa_mutacao):
        """Determina a mutação dos cromossomos""" 
        for i in range(len(self.cromossomo)):
            if random() < taxa_mutacao:
                if (type(minimos[i]) == float) and (type(maximos[i]) == float):
                    self.cromossomo[i] = random.uniform(minimos[i], maximos[i]) #instance
                else:
                    self.cromossomo[i] = randint(minimos[i], maximos[i]) 
        return self

class AlgoritmoGenetico():
    def __init__(self, tamanho_populacao):
        self.tamanho_populacao = tamanho_populacao
        self.populacao = []
        self.geracao = 0
        self.melhor_solucao = 0

    def inicializa_populacao(self, minimos, maximos):
        for i in range(self.tamanho_populacao):
            self.populacao.append(Individuo(minimos, maximos))
        self.melhor_solucao = self.populacao[0] 

    def ordena_populacao(self):
        #AQUI DEVE ENTRAR SE É MINIMIZAÇÃO OU MAXIMIZAÇÃO
        self.populacao = sorted(self.populacao,
                                key = lambda populacao: populacao.nota_avaliacao,
                                reverse = True) 
        """
        self.populacao = sorted(self.populacao,
                                key = lambda populacao: populacao.nota_avaliacao)
        """

        #HÁ ALTERAÇÃO NOS VALORES, MAS AINDA NÃO ENTENDO SE ESTÁ BOM OU NÃO :/
        #AINDA A MELHOR SOLUÇÃO NÃO É O MENOR NÚMERO




    def melhor_individuo(self, individuo):
        if individuo.nota_avaliacao > self.melhor_solucao.nota_avaliacao:
            self.melhor_solucao = individuo

    def soma_avaliacoes(self):
        soma = 0
        for individuo in self.populacao:
            soma += individuo.nota_avaliacao
        return soma

    def seleciona_pai(self, soma_avaliacao):
        """Seleção dos indivíduos - método Roleta Viciada"""
        pai = -1
        valor_sorteado = random() * soma_avaliacao
        soma = 0
        i = 0
        while i < len(self.populacao) and soma < valor_sorteado:
            soma += self.populacao[i].nota_avaliacao
            pai += 1
            i += 1
        return pai

    def visualiza_geracao(self): #DADOS DO GA(raspar para uma planilha Excel)
        melhor = self.populacao[0]
        print("G:%s --> Valor: %s Cromossomo: %s" % (self.populacao[0].geracao,
                                                     melhor.nota_avaliacao,
                                                     melhor.cromossomo))


    def resolver(self, taxa_mutacao, numero_geracao):
        self.inicializa_populacao(minimos, maximos)

        for individuo in self.populacao:                #primeira geração (aleatória)
            individuo.avaliacao()

        self.ordena_populacao()
        self.visualiza_geracao()

        for geracao in range(numero_geracao):           #gerações novas
            soma_avaliacao = self.soma_avaliacoes()
            nova_populacao = []

            for individuos_gerados in range(0, self.tamanho_populacao, 2):
                pai1 = self.seleciona_pai(soma_avaliacao)
                pai2 = self.seleciona_pai(soma_avaliacao)

                filhos = self.populacao[pai1].crossover(self.populacao[pai2])

                nova_populacao.append(filhos[0].mutacao(taxa_mutacao))
                nova_populacao.append(filhos[1].mutacao(taxa_mutacao))

            self.populacao = list(nova_populacao)

            for individuo in self.populacao:
                individuo.avaliacao()

            self.ordena_populacao()
            self.visualiza_geracao()

            melhor = self.populacao[0]
            self.melhor_individuo(melhor)
        
        print("\nMelhor solução -> G: %s Valor: %s Cromossomo: %s" %
              (self.melhor_solucao.geracao,
               self.melhor_solucao.nota_avaliacao,
               self.melhor_solucao.cromossomo))
        
        return self.melhor_solucao.cromossomo


if Toggle: #método __main__

    lista_parametros = []
    lista_parametros.append(Parametro('Altura', 1, 5))
    lista_parametros.append(Parametro('Largura', 6, 10))
    lista_parametros.append(Parametro('Profundidade', 11, 20))
    #for parametro in lista_parametros:
        #print(parametro.nome)

    minimos = []
    maximos = []
    nomes = []
    for parametro in lista_parametros:       
        minimos.append(parametro.minimo)
        maximos.append(parametro.maximo)
        nomes.append(parametro.nome)

    tamanho_populacao = 20
    taxa_mutacao = 0.05
    numero_geracao = 100
    ag = AlgoritmoGenetico(tamanho_populacao)

    #saida_inputs =           #AQUI DEVE INICILIZAR INPUTS PARA "EXPLODE TREE" PARA LIGAR AO MODELO
    #FUNÇÃO PARECIDA COM 'RESOLVER' OU BUSCAR NO 'INICILIZA' POPULAÇÃO, PARTE ALEATÓRIA

    #tipo um inicia = ag.saída #uma função para inicializar apenas um individuo para explodir as saídas

    resultado = ag.resolver(taxa_mutacao, numero_geracao)
# ---------- end ghpython_script_7 ----------
ghpython_script_8 = GhPythonScript(Toggle=toggle)  # -> out, a
# ---------- ghpython_script_8: Python ----------
__author__ = "Renato Godoi da Cruz"
__version__ = "2020.08.20"


import rhinoscriptsyntax as rs

from random import random, randint

class Parametro():
    """No Grasshopper, todo paamêtro tem 1 nome e um valor que vai de um min até um max."""
    def __init__(self, nome, minimo, maximo):    #o valor entra nesse algoritmo
        self.nome = nome                         #parametro nome. Ex.: largura
        self.minimo = minimo                     #parametro min. Ex.: 1
        self.maximo = maximo                     #parametro max. Ex.: 10

#o cromossomo (str) será o conjuntos dos valores (escolhidos entre o min e o max)
#o individuo será o próprio cromossomo
class Individuo():
    """Definição"""
    def __init__(self, minimos, maximos, geracao=0):
        self.minimos = minimos
        self.maximos = maximos
        self.nota_avaliacao = 0
        self.geracao = geracao
        self.cromossomo = []                     #valores entre min e max dos parametros

        for i in range(len(lista_parametros)):   #escolher valores entre min e max aleatoriamente
            if (type(minimos[i]) == float) and (type(maximos[i]) == float):
                self.cromossomo.append(random.uniform(minimos[i], maximos[i])) #instance
            else:
                self.cromossomo.append(randint(minimos[i], maximos[i])) 

    def avaliacao(self):
        """Função fitness"""
        #Aqui deve receber o valor_objetivo de cada individuo (vem do modelo) Por exemplo, relação área/volume
        nota =randint(1000, 2222) #função provisório para continuar o desenv. script
        self.nota_avaliacao = nota

    def crossover(self, outro_individuo):
        """Determina o ponto de crossover"""
        corte = int(round(random()  * len(self.cromossomo))) #um número randômico (0 ou 1) vai multiplicar pelo tamanho do cromossomo (round é para arredondar)

        
        filho1 = outro_individuo.cromossomo[0:corte] + self.cromossomo[corte::]  #o filho recebe parte do cromossomo (de 0 até corte) do outro indíviduo
        filho2 = self.cromossomo[0:corte] + outro_individuo.cromossomo[corte::]  #o outro_ind é o individuo2 

        filhos = [Individuo(self.minimos, self.maximos, self.geracao + 1),
                  Individuo(self.minimos, self.maximos, self.geracao + 1)]
        filhos[0].cromossomo = filho1   #filho 1 e 2 na verdade está criando cromossomos
        filhos[1].cromossomo = filho2
        return filhos

    def mutacao(self, taxa_mutacao):
        """Determina a mutação dos cromossomos""" 
        for i in range(len(self.cromossomo)):
            if random() < taxa_mutacao:
                if (type(minimos[i]) == float) and (type(maximos[i]) == float):
                    self.cromossomo[i] = random.uniform(minimos[i], maximos[i]) #instance
                else:
                    self.cromossomo[i] = randint(minimos[i], maximos[i]) 
        return self

class AlgoritmoGenetico():
    def __init__(self, tamanho_populacao):
        self.tamanho_populacao = tamanho_populacao
        self.populacao = []
        self.geracao = 0
        self.melhor_solucao = 0

    def inicializa_populacao(self, minimos, maximos):
        for i in range(self.tamanho_populacao):
            self.populacao.append(Individuo(minimos, maximos))
        self.melhor_solucao = self.populacao[0] 

    def ordena_populacao(self):
        #AQUI DEVE ENTRAR SE É MINIMIZAÇÃO OU MAXIMIZAÇÃO
        self.populacao = sorted(self.populacao,
                                key = lambda populacao: populacao.nota_avaliacao,
                                reverse = True)

    def melhor_individuo(self, individuo):
        if individuo.nota_avaliacao > self.melhor_solucao.nota_avaliacao:
            self.melhor_solucao = individuo

    def soma_avaliacoes(self):
        soma = 0
        for individuo in self.populacao:
            soma += individuo.nota_avaliacao
        return soma

    def seleciona_pai(self, soma_avaliacao):
        """Seleção dos indivíduos - método Roleta Viciada"""
        pai = -1
        valor_sorteado = random() * soma_avaliacao
        soma = 0
        i = 0
        while i < len(self.populacao) and soma < valor_sorteado:
            soma += self.populacao[i].nota_avaliacao
            pai += 1
            i += 1
        return pai
    
    def visualiza_geracao(self): #DADOS DO GA(raspar para uma planilha Excel)
        melhor = self.populacao[0]
        print("G:%s --> Valor: %s Cromossomo: %s" % (self.populacao[0].geracao,
                                                     melhor.nota_avaliacao,
                                                     melhor.cromossomo))
    
    def resolver(self, taxa_mutacao, numero_geracao):
        self.inicializa_populacao(minimos, maximos)
        
        for individuo in self.populacao:                #primeira geração (aleatória)
            individuo.avaliacao()
        
        self.ordena_populacao()
        
        self.visualiza_geracao()
        
        for geracao in range(numero_geracao):           #gerações novas
            soma_avaliacao = self.soma_avaliacoes()
            nova_populacao = []
            
            for individuos_gerados in range(0, self.tamanho_populacao, 2):
                pai1 = self.seleciona_pai(soma_avaliacao)
                pai2 = self.seleciona_pai(soma_avaliacao)
                
                filhos = self.populacao[pai1].crossover(self.populacao[pai2])
                
                nova_populacao.append(filhos[0].mutacao(taxa_mutacao))
                nova_populacao.append(filhos[1].mutacao(taxa_mutacao))
            
            self.populacao = list(nova_populacao)
            
            for individuo in self.populacao:
                individuo.avaliacao()
            
            self.ordena_populacao()
            
            self.visualiza_geracao()
            
            melhor = self.populacao[0]
            self.melhor_individuo(melhor)
        
        print("\nMelhor solução -> G: %s Valor: %s Cromossomo: %s" %
              (self.melhor_solucao.geracao,
               self.melhor_solucao.nota_avaliacao,
               self.melhor_solucao.cromossomo))
        
        return self.melhor_solucao.cromossomo

if Toggle: #método __main__

    lista_parametros = []
    lista_parametros.append(Parametro('Altura', 1, 5))
    lista_parametros.append(Parametro('Largura', 6, 10))
    lista_parametros.append(Parametro('Profundidade', 11, 20))
    #for parametro in lista_parametros:
        #print(parametro.nome)
    
    minimos = []
    maximos = []
    nomes = []
    for parametro in lista_parametros:       
        minimos.append(parametro.minimo)
        maximos.append(parametro.maximo)
        nomes.append(parametro.nome)

    tamanho_populacao = 20
    taxa_mutacao = 0.05
    numero_geracao = 100
    ag = AlgoritmoGenetico(tamanho_populacao)
    resultado = ag.resolver(taxa_mutacao, numero_geracao)
# ---------- end ghpython_script_8 ----------
explode_tree = ExplodeTree()  # -> Branch0, Branch1
panel_2 = Panel(ghpython_script_8.out)
panel_3 = Panel(python_5.out)
panel_4 = Panel(ghpython_script_4.out)
panel_5 = Panel(python_6.out)
param_viewer = ParamViewer(ghpython_script_2.input)
bang = ExplodeTree(Data=ghpython_script_2.input)  # -> Branch0, Branch1, Branch2
expression = Expression(x=bang.Branch0, y=bang.Branch1, z=bang.Branch2, Expression="x+y+z")
data_recorder = DataRecorder(expression, DataLimit=-10, RecordData=True)
panel_6 = Panel(ghpython_script_3.out)
panel_7 = Panel(ghpython_script_3.input)
panel_8 = Panel(data_recorder)

series = Series(Start=0, Step="2", Count="2")
series_2 = Series(Start=0, Step="6", Count="6")
series_3 = Series(Start=0, Step=2, Count="4")
entwine = Entwine(Branch00=series, Branch01=series_2, Branch02=series_3, FlattenInputs=True)
param_viewer_2 = ParamViewer(entwine)
panel_9 = Panel(entwine)
bang_2 = ExplodeTree(Data=entwine)  # -> Branch0, Branch1, Branch2
explodetree = PythonScript(D=entwine)  # -> _0_0, _0_1, _0_2; inputs D: tree
#   port _0_0: All data at index: 0
#   port _0_1: All data at index: 1
#   port _0_2: All data at index: 2
# ---------- explodetree: Python ----------
"""
Mocks the functionality of ExplodeTree (BANG!)
    Inputs:
        D: The data to explode.
"""
from ghpythonlib.componentbase import executingcomponent as component
import Grasshopper, GhPython
import System
import Rhino
import System.Windows.Forms.MessageBox as mb

class MyComponent(component):
    
    def __init__(self):
        self.last_d = None
    
    
    def RunScript(self, D):
        self.last_d = D
        
        numberOfOutputs = self.Params.Output.Count - (0 if ghenv.Component.HiddenOutOutput else 1)
        
        if len(D.Paths) == numberOfOutputs:
            result = []
            
            for i, path in enumerate(D.Paths):
                result.append(D.Branches[i])
            return result
        else:
            self.AddRuntimeMessage(Grasshopper.Kernel.GH_RuntimeMessageLevel.Warning, "You must match outputs first.")
            return None
    
    
    #http://developer.rhino3d.com/api/grasshopper/html/M_Grasshopper_Kernel_GH_Component_AppendAdditionalComponentMenuItems.htm
    def AppendAdditionalComponentMenuItems(self, menu):
        try:
            menu.Items.Add("Match outputs", None, self.MenuClick)
        except Exception, ex:
            mb.Show("Error: " + str(ex))
    
    
    def MenuClick(self, sender, args):
        try:
            #add here stuff
            self.adjustParams()
            self.OnPingDocument().ExpireSolution()
            expireAllObjects = True
            self.OnPingDocument().NewSolution(expireAllObjects)
        except Exception, ex:
            mb.Show("Error: " + str(ex))
    
    
    def addOutputParam(self, outputIndex, name):
        param = Grasshopper.Kernel.Parameters.Param_GenericObject()
        param.NickName = name
        param.Name = name
        param.Description = str.format("All data at index: {0}", outputIndex)
        self.Params.RegisterOutputParam(param, outputIndex)
    
    
    def adjustParams(self):
        numberOfOutputs = self.Params.Output.Count
        start_index = 0
        
        if not ghenv.Component.HiddenOutOutput: start_index = 1
        
        outputParamsIndices = range(start_index, self.Params.Output.Count)  # never include "output"
        outputParamsIndices.reverse()  # remove the parameters from the end
        for index in outputParamsIndices:
            isolate = True
            self.Params.UnregisterOutputParameter(self.Params.Output.Item[index], isolate)
        
        for i, path in enumerate(self.last_d.Paths):
            self.addOutputParam(i + start_index, str(path))
        
        ghenv.Component.Params.OnParametersChanged()
# ---------- end explodetree ----------
explode_tree_2 = ExplodeTree(Data=entwine)  # -> Branch0, Branch1, Branch2
panel_10 = Panel(explodetree._0_1)
panel_11 = Panel(explodetree._0_2)
panel_12 = Panel(explodetree._0_0)

number_slider = Slider(3, range=0..10)
number_slider_2 = Slider(100, range=0..200)
number_slider_3 = Slider(30, range=0..50)
number_slider_4 = Slider(0.05, range=0..1)
ga = PythonScript(limite=number_slider, tamanho_populacao=number_slider_3, taxa_mutacao=number_slider_4, numero_geracoes=number_slider_2)  # -> out, a; inputs limite: Int32, tamanho_populacao: Int32, numero_geracoes: Int32
# ---------- ga: Python ----------
"""
Created on April 18, 2020
    @author: Renato Godoi da Cruz
    email: renatogcruz@hotmail.com
"""

from random import random

class Produto():
    """Cria a classe Produtos"""
    def __init__(self, nome, espaco, valor):
        self.nome = nome
        self.espaco = espaco
        self.valor = valor

#Classe indivíduo I 
#(indivíduos representam as soluções)
#(um conj. de individuos formam uma população)
#(O cromossomo representa uma solução)
#(O indiv. pode ser o próprio cromossomo ou pode conter o cromossomo como atributo [dependendo do caso])
#(gelad. = 0, iphone = 1, notebook = 0, ... (formam o cromossomo '0, 1, 0, ...' que nada mais é do que um conjunto de string")

class Individuo():
    """Cria a classe Indivíduo"""
    def __init__(self, espacos, valores, limite_espacos, geracao=0):
        self.espacos = espacos
        self.valores = valores
        self.limite_espacos = limite_espacos
        self.nota_avaliacao = 0              #somatório dos valores da carga
        self.espaco_usado = 0                #espaço total usado pela carga
        self.geracao = geracao
        self.cromossomo = []
        
        #GERAÇÃO INICIAL este 'for' inicia a primeira população (aleatória)
        for i in range(len(espacos)):        #esse for vai de gero até o espaço que ainda tem para carregar ou não um produto
            if random() < 0.5:               #gera um num. entre 0 e 1 (valores que compõe o cromossomo)
                self.cromossomo.append("0")
            else:
                self.cromossomo.append("1")

    def avaliacao(self):
        """Função para avaliar os indívuos (conjuntos de cromossomos)"""
        nota = 0
        soma_espacos = 0
        for i in range(len(self.cromossomo)):
           if self.cromossomo[i] == '1':
               nota += self.valores[i]
               soma_espacos += self.espacos[i]
        if soma_espacos > self.limite_espacos:
            nota = 1
        self.nota_avaliacao = nota
        self.espaco_usado = soma_espacos

    #CROSSOVER combina pedaços de cromossomos de dois genitores gerando filhos mais aptos
    def crossover(self, outro_individuo):
        """Determina o ponto de crossover"""
        corte = int(round(random()  * len(self.cromossomo)))                     #um número randômico (0 ou 1) vai multiplicar pelo tamanho do cromossomo (round é para arredondar)
        
        filho1 = outro_individuo.cromossomo[0:corte] + self.cromossomo[corte::]  #o filho recebe parte do cromossomo (de 0 até corte) do outro indíviduo
        filho2 = self.cromossomo[0:corte] + outro_individuo.cromossomo[corte::]  #o outro_ind é o individuo2 
        
        filhos = [Individuo(self.espacos, self.valores, self.limite_espacos, self.geracao + 1),
                  Individuo(self.espacos, self.valores, self.limite_espacos, self.geracao + 1)]
        filhos[0].cromossomo = filho1   #filho 1 e 2 na verdade está criando cromossomos
        filhos[1].cromossomo = filho2
        return filhos
    
    def mutacao(self, taxa_mutacao):
        """Função para mutação"""
        #print("Antes %s " % self.cromossomo)
        for i in range(len(self.cromossomo)):
            if random() < taxa_mutacao:
                if self.cromossomo[i] == '1':
                    self.cromossomo[i] = '0'
                else:
                    self.cromossomo[i] = '1'
        #print("Depois %s " % self.cromossomo)
        return self
        
class AlgoritmoGenetico():
    """Classe que implementa o Algoritmo Genético"""
    def __init__(self, tamanho_populacao):
        self.tamanho_populacao = tamanho_populacao
        self.populacao = []
        self.geracao = 0
        self.melhor_solucao = 0
        
    def inicializa_populacao(self, espacos, valores, limite_espacos):
        for i in range(self.tamanho_populacao):
            self.populacao.append(Individuo(espacos, valores, limite_espacos))
        self.melhor_solucao = self.populacao[0]
        
    def ordena_populacao(self):
        self.populacao = sorted(self.populacao,
                                key = lambda populacao: populacao.nota_avaliacao,
                                reverse = True)
        
    def melhor_individuo(self, individuo):
        if individuo.nota_avaliacao > self.melhor_solucao.nota_avaliacao:
            self.melhor_solucao = individuo
            
    def soma_avaliacoes(self):
        soma = 0
        for individuo in self.populacao:
           soma += individuo.nota_avaliacao
        return soma
    
    def seleciona_pai(self, soma_avaliacao):
        """Seleção dos indivíduos - método Roleta Viciada"""
        pai = -1
        valor_sorteado = random() * soma_avaliacao
        soma = 0
        i = 0
        while i < len(self.populacao) and soma < valor_sorteado:
            soma += self.populacao[i].nota_avaliacao
            pai += 1
            i += 1
        return pai
    
    def visualiza_geracao(self):
        """Função para visualizar os melhores indivíduos de cada geração"""
        melhor = self.populacao[0]
        print("G:%s -> Valor: %s Espaço: %s Cromossomo: %s" % (self.populacao[0].geracao,
                                                               melhor.nota_avaliacao,
                                                               melhor.espaco_usado,
                                                               melhor.cromossomo))
    
    def resolver(self, taxa_mutacao, numero_geracoes, espacos, valores, limite_espacos):
        self.inicializa_populacao(espacos, valores, limite_espacos)
        
        for individuo in self.populacao:
            individuo.avaliacao()
        
        self.ordena_populacao()
        
        self.visualiza_geracao()
        
        for geracao in range(numero_geracoes):
            soma_avaliacao = self.soma_avaliacoes()
            nova_populacao = []
            
            for individuos_gerados in range(0, self.tamanho_populacao, 2):
                pai1 = self.seleciona_pai(soma_avaliacao)
                pai2 = self.seleciona_pai(soma_avaliacao)
                
                filhos = self.populacao[pai1].crossover(self.populacao[pai2])
                
                nova_populacao.append(filhos[0].mutacao(taxa_mutacao))
                nova_populacao.append(filhos[1].mutacao(taxa_mutacao))
            
            self.populacao = list(nova_populacao)
            
            for individuo in self.populacao:
                individuo.avaliacao()
            
            self.ordena_populacao()
            
            self.visualiza_geracao()
            
            melhor = self.populacao[0]
            self.melhor_individuo(melhor)
        
        print("\nMelhor solução -> G: %s Valor: %s Espaço: %s Cromossomo: %s" %
              (self.melhor_solucao.geracao,
               self.melhor_solucao.nota_avaliacao,
               self.melhor_solucao.espaco_usado,
               self.melhor_solucao.cromossomo))
        
        return self.melhor_solucao.cromossomo

#EXECUTOR
if __name__ == '__main__':
    #p1 = Produto("Iphone 6", 0.0000899, 2199.12)
    lista_produtos = []
    lista_produtos.append(Produto("Geladeira Dako", 0.751, 999.90))
    lista_produtos.append(Produto("Iphone 6", 0.0000899, 2911.12))
    lista_produtos.append(Produto("TV 55' ", 0.400, 4346.99))
    lista_produtos.append(Produto("TV 50' ", 0.290, 3999.90))
    lista_produtos.append(Produto("TV 42' ", 0.200, 2999.00))
    lista_produtos.append(Produto("Notebook Dell", 0.00350, 2499.90))
    lista_produtos.append(Produto("Ventilador Panasonic", 0.496, 199.90))
    lista_produtos.append(Produto("Microondas Electrolux", 0.0424, 308.66))
    lista_produtos.append(Produto("Microondas LG", 0.0544, 429.90))
    lista_produtos.append(Produto("Microondas Panasonic", 0.0319, 299.29))
    lista_produtos.append(Produto("Geladeira Brastemp", 0.635, 849.00))
    lista_produtos.append(Produto("Geladeira Consul", 0.870, 1199.89))
    lista_produtos.append(Produto("Notebook Lenovo", 0.498, 1999.90))
    lista_produtos.append(Produto("Notebook Asus", 0.527, 3999.00))

    espacos = []
    valores = []
    nomes = []
    for produto in lista_produtos:
        espacos.append(produto.espaco)
        valores.append(produto.valor)
        nomes.append(produto.nome)

#    limite = 3
#    tamanho_populacao = 30
#    taxa_mutacao = 0.05
#    numero_geracoes = 100

    ag = AlgoritmoGenetico(tamanho_populacao)
    resultado = ag.resolver(taxa_mutacao, numero_geracoes, espacos, valores, limite)

    for i in range(len(lista_produtos)):
        if resultado[i] == '1':
            print("Nome: %s R$ %s " % (lista_produtos[i].nome,
                                       lista_produtos[i].valor))
# ---------- end ga ----------
ga_1 = PythonScript(limite=number_slider, tamanho_populacao=number_slider_3, taxa_mutacao=number_slider_4, numero_geracoes=number_slider_2)  # -> out, a; inputs limite: Int32, tamanho_populacao: Int32, numero_geracoes: Int32
# ---------- ga_1: Python ----------
"""
Created on April 18, 2020
    @author: Renato Godoi da Cruz
    email: renatogcruz@hotmail.com
    referência: https://www.udemy.com/course/algoritmos-geneticos-em-python/
"""

from random import random

class Parametro():
    """Cria a classe Parametro (antigo Produto)"""
    #TAREFA - deve ter somento 'nome' e 'número'. 'Número' deve ser escolhido entre um min. e um máx.
    #TAREFA - valor aqui funciona como 
    def __init__(self, nome, espaco, valor):
        self.nome = nome
        self.espaco = espaco
        self.valor = valor

#Classe indivíduo I 
#(indivíduos representam as soluções)
#(um conj. de individuos formam uma população)
#(O cromossomo representa uma solução)
#(O indiv. pode ser o próprio cromossomo ou pode conter o cromossomo como atributo [dependendo do caso])
#(gelad. = 0, iphone = 1, notebook = 0, ... (formam o cromossomo '0, 1, 0, ...' que nada mais é do que um conjunto de string")

# TAREFA - neste caso, O indiv. pode ser o próprio cromossomo, 
#          ou seja, o valor dos paramêtros (já que este define o design no Grasshopper
# TAREFA - como fazer? cromossomo == 'valor'(parametro1), 'valor'(parametro2), etc)
class Individuo():
    """Cria a classe Indivíduo"""
    def __init__(self, espacos, valores, limite_espacos, geracao=0):
        self.espacos = espacos
        self.valores = valores
        self.limite_espacos = limite_espacos
        self.nota_avaliacao = 0              #somatório dos valores da carga
        # TAREFA: nota_avaliação é o valor_objetivo (objetivo)
        self.espaco_usado = 0                #espaço total usado pela carga
        # TAREFA: Não vai ter mais espaço usado. Isso funciona aqui como um regra 
        #         de restrição, pode ser externo.
        self.geracao = geracao
        self.cromossomo = []
        
        #GERAÇÃO INICIAL este 'for' inicia a primeira população (aleatória)
        # TAREFA - Precisa definir os números (valores do parametros) e 
        #          juntar na forma de cromossomo
        for i in range(len(espacos)):        #esse for vai de zero até o espaço que ainda tem para carregar ou não um produto
            if random() < 0.5:               #gera um num. entre 0 e 1 (valores que compõe o cromossomo)
                self.cromossomo.append("0")
            else:
                self.cromossomo.append("1")

    def avaliacao(self):
        """Função para avaliar os indívuos (conjuntos de cromossomos)"""
        # TAREFA - aqui deve ser definido se é maximação ou minimização
        nota = 0
        soma_espacos = 0
        for i in range(len(self.cromossomo)):
           if self.cromossomo[i] == '1':
               nota += self.valores[i]
               soma_espacos += self.espacos[i]
        if soma_espacos > self.limite_espacos:
            nota = 1
        self.nota_avaliacao = nota
        self.espaco_usado = soma_espacos

    #CROSSOVER combina pedaços de cromossomos de dois genitores gerando filhos mais aptos
    def crossover(self, outro_individuo):
        """Determina o ponto de crossover"""
        corte = int(round(random()  * len(self.cromossomo)))                     #um número randômico (0 ou 1) vai multiplicar pelo tamanho do cromossomo (round é para arredondar)
        
        filho1 = outro_individuo.cromossomo[0:corte] + self.cromossomo[corte::]  #o filho recebe parte do cromossomo (de 0 até corte) do outro indíviduo
        filho2 = self.cromossomo[0:corte] + outro_individuo.cromossomo[corte::]  #o outro_ind é o individuo2 
        
        filhos = [Individuo(self.espacos, self.valores, self.limite_espacos, self.geracao + 1),
                  Individuo(self.espacos, self.valores, self.limite_espacos, self.geracao + 1)]
        filhos[0].cromossomo = filho1   #filho 1 e 2 na verdade está criando cromossomos
        filhos[1].cromossomo = filho2
        return filhos
    
    def mutacao(self, taxa_mutacao):
        """Função para mutação"""
        #print("Antes %s " % self.cromossomo)
        for i in range(len(self.cromossomo)):
            if random() < taxa_mutacao:
                if self.cromossomo[i] == '1':
                    self.cromossomo[i] = '0'
                else:
                    self.cromossomo[i] = '1'
        #print("Depois %s " % self.cromossomo)
        return self
        
class AlgoritmoGenetico():
    """Classe que implementa o Algoritmo Genético"""
    def __init__(self, tamanho_populacao):
        self.tamanho_populacao = tamanho_populacao
        self.populacao = []
        self.geracao = 0
        self.melhor_solucao = 0
        
    def inicializa_populacao(self, espacos, valores, limite_espacos):
        for i in range(self.tamanho_populacao):
            self.populacao.append(Individuo(espacos, valores, limite_espacos))
        self.melhor_solucao = self.populacao[0]
        
    def ordena_populacao(self):
        self.populacao = sorted(self.populacao,
                                key = lambda populacao: populacao.nota_avaliacao,
                                reverse = True)
        
    def melhor_individuo(self, individuo):
        if individuo.nota_avaliacao > self.melhor_solucao.nota_avaliacao:
            self.melhor_solucao = individuo
            
    def soma_avaliacoes(self):
        soma = 0
        for individuo in self.populacao:
           soma += individuo.nota_avaliacao
        return soma
    
    def seleciona_pai(self, soma_avaliacao):
        """Seleção dos indivíduos - método Roleta Viciada"""
        pai = -1
        valor_sorteado = random() * soma_avaliacao
        soma = 0
        i = 0
        while i < len(self.populacao) and soma < valor_sorteado:
            soma += self.populacao[i].nota_avaliacao
            pai += 1
            i += 1
        return pai
    
    def visualiza_geracao(self):
        """Função para visualizar os melhores indivíduos de cada geração"""
        melhor = self.populacao[0]
        print("G:%s -> Valor: %s Espaço: %s Cromossomo: %s" % (self.populacao[0].geracao,
                                                               melhor.nota_avaliacao,
                                                               melhor.espaco_usado,
                                                               melhor.cromossomo))
    
    def resolver(self, taxa_mutacao, numero_geracoes, espacos, valores, limite_espacos):
        self.inicializa_populacao(espacos, valores, limite_espacos)
        
        for individuo in self.populacao:
            individuo.avaliacao()
        
        self.ordena_populacao()
        
        self.visualiza_geracao()
        
        for geracao in range(numero_geracoes):
            soma_avaliacao = self.soma_avaliacoes()
            nova_populacao = []
            
            for individuos_gerados in range(0, self.tamanho_populacao, 2):
                pai1 = self.seleciona_pai(soma_avaliacao)
                pai2 = self.seleciona_pai(soma_avaliacao)
                
                filhos = self.populacao[pai1].crossover(self.populacao[pai2])
                
                nova_populacao.append(filhos[0].mutacao(taxa_mutacao))
                nova_populacao.append(filhos[1].mutacao(taxa_mutacao))
            
            self.populacao = list(nova_populacao)
            
            for individuo in self.populacao:
                individuo.avaliacao()
            
            self.ordena_populacao()
            
            self.visualiza_geracao()
            
            melhor = self.populacao[0]
            self.melhor_individuo(melhor)
        
        print("\nMelhor solução -> G: %s Valor: %s Espaço: %s Cromossomo: %s" %
              (self.melhor_solucao.geracao,
               self.melhor_solucao.nota_avaliacao,
               self.melhor_solucao.espaco_usado,
               self.melhor_solucao.cromossomo))
        
        return self.melhor_solucao.cromossomo

#EXECUTOR
if __name__ == '__main__':
    #p1 = Parametro("Iphone 6", 0.0000899, 2199.12)
    lista_parametros = []
    lista_parametros.append(Parametro("Geladeira Dako", 0.751, 999.90))
    lista_parametros.append(Parametro("Iphone 6", 0.0000899, 2911.12))
    lista_parametros.append(Parametro("TV 55' ", 0.400, 4346.99))
    lista_parametros.append(Parametro("TV 50' ", 0.290, 3999.90))
    lista_parametros.append(Parametro("TV 42' ", 0.200, 2999.00))
    lista_parametros.append(Parametro("Notebook Dell", 0.00350, 2499.90))
    lista_parametros.append(Parametro("Ventilador Panasonic", 0.496, 199.90))
    lista_parametros.append(Parametro("Microondas Electrolux", 0.0424, 308.66))
    lista_parametros.append(Parametro("Microondas LG", 0.0544, 429.90))
    lista_parametros.append(Parametro("Microondas Panasonic", 0.0319, 299.29))
    lista_parametros.append(Parametro("Geladeira Brastemp", 0.635, 849.00))
    lista_parametros.append(Parametro("Geladeira Consul", 0.870, 1199.89))
    lista_parametros.append(Parametro("Notebook Lenovo", 0.498, 1999.90))
    lista_parametros.append(Parametro("Notebook Asus", 0.527, 3999.00))

    espacos = []
    valores = []
    nomes = []
    for parametro in lista_parametros:
        espacos.append(parametro.espaco)
        valores.append(parametro.valor)
        nomes.append(parametro.nome)

#    limite = 3
#    tamanho_populacao = 30
#    taxa_mutacao = 0.05
#    numero_geracoes = 100

    ag = AlgoritmoGenetico(tamanho_populacao)
    resultado = ag.resolver(taxa_mutacao, numero_geracoes, espacos, valores, limite)

    for i in range(len(lista_parametros)):
        if resultado[i] == '1':
            print("Nome: %s R$ %s " % (lista_parametros[i].nome,
                                       lista_parametros[i].valor))
# ---------- end ga_1 ----------
ga_2 = PythonScript(limite=number_slider, tamanho_populacao=number_slider_3, taxa_mutacao=number_slider_4, numero_geracoes=number_slider_2)  # -> out, a; inputs limite: Int32, tamanho_populacao: Int32, numero_geracoes: Int32
# ---------- ga_2: Python ----------
"""
Created on April 18, 2020
    @author: Renato Godoi da Cruz
    email: renatogcruz@hotmail.com
    referência: https://www.udemy.com/course/algoritmos-geneticos-em-python/
"""

from random import random

class Parametro():
    """Cria a classe Parametro (antigo Produto)"""
    #TAREFA - deve ter somento 'nome' e 'número'. 'Número' deve ser escolhido entre um min. e um máx.
    #TAREFA - valor aqui funciona como 
    def __init__(self, nome, espaco, valor):
        self.nome = nome
        self.espaco = espaco
        self.valor = valor

#Classe indivíduo I 
#(indivíduos representam as soluções)
#(um conj. de individuos formam uma população)
#(O cromossomo representa uma solução)
#(O indiv. pode ser o próprio cromossomo ou pode conter o cromossomo como atributo [dependendo do caso])
#(gelad. = 0, iphone = 1, notebook = 0, ... (formam o cromossomo '0, 1, 0, ...' que nada mais é do que um conjunto de string")

# TAREFA - neste caso, O indiv. pode ser o próprio cromossomo, 
#          ou seja, o valor dos paramêtros (já que este define o design no Grasshopper
# TAREFA - como fazer? cromossomo == 'valor'(parametro1), 'valor'(parametro2), etc)
class Individuo():
    """Cria a classe Indivíduo"""
    def __init__(self, espacos, valores, limite_espacos, geracao=0):
        self.espacos = espacos
        self.valores = valores
        self.limite_espacos = limite_espacos
        self.nota_avaliacao = 0              #somatório dos valores da carga
        # TAREFA: nota_avaliação é o valor_objetivo (objetivo)
        self.espaco_usado = 0                #espaço total usado pela carga
        # TAREFA: Não vai ter mais espaço usado. Isso funciona aqui como um regra 
        #         de restrição, pode ser externo.
        self.geracao = geracao
        self.cromossomo = []
        
        #GERAÇÃO INICIAL este 'for' inicia a primeira população (aleatória)
        # TAREFA - Precisa definir os números (valores do parametros) e 
        #          juntar na forma de cromossomo
        for i in range(len(espacos)):        #esse for vai de zero até o espaço que ainda tem para carregar ou não um produto
            if random() < 0.5:               #gera um num. entre 0 e 1 (valores que compõe o cromossomo)
                self.cromossomo.append("0")
            else:
                self.cromossomo.append("1")

    def avaliacao(self):
        """Função para avaliar os indívuos (conjuntos de cromossomos)"""
        # TAREFA - aqui deve ser definido se é maximação ou minimização
        #          vamos criar uma função simples += só para testar
        nota = 0
        soma_espacos = 0
        for i in range(len(self.cromossomo)):
           if self.cromossomo[i] == '1':
               nota += self.valores[i]
               soma_espacos += self.espacos[i]
        if soma_espacos > self.limite_espacos:
            nota = 1
        self.nota_avaliacao = nota
        self.espaco_usado = soma_espacos

    #CROSSOVER combina pedaços de cromossomos de dois genitores gerando filhos mais aptos
    def crossover(self, outro_individuo):
        """Determina o ponto de crossover"""
        corte = int(round(random()  * len(self.cromossomo)))                     #um número randômico (0 ou 1) vai multiplicar pelo tamanho do cromossomo (round é para arredondar)
        
        filho1 = outro_individuo.cromossomo[0:corte] + self.cromossomo[corte::]  #o filho recebe parte do cromossomo (de 0 até corte) do outro indíviduo
        filho2 = self.cromossomo[0:corte] + outro_individuo.cromossomo[corte::]  #o outro_ind é o individuo2 
        
        filhos = [Individuo(self.espacos, self.valores, self.limite_espacos, self.geracao + 1),
                  Individuo(self.espacos, self.valores, self.limite_espacos, self.geracao + 1)]
        filhos[0].cromossomo = filho1   #filho 1 e 2 na verdade está criando cromossomos
        filhos[1].cromossomo = filho2
        return filhos
    
    def mutacao(self, taxa_mutacao):
        """Função para mutação"""
        #print("Antes %s " % self.cromossomo)
        for i in range(len(self.cromossomo)):
            if random() < taxa_mutacao:
                if self.cromossomo[i] == '1':
                    self.cromossomo[i] = '0'
                else:
                    self.cromossomo[i] = '1'
        #print("Depois %s " % self.cromossomo)
        return self
        
class AlgoritmoGenetico():
    """Classe que implementa o Algoritmo Genético"""
    def __init__(self, tamanho_populacao):
        self.tamanho_populacao = tamanho_populacao
        self.populacao = []
        self.geracao = 0
        self.melhor_solucao = 0
        
    def inicializa_populacao(self, espacos, valores, limite_espacos):
        for i in range(self.tamanho_populacao):
            self.populacao.append(Individuo(espacos, valores, limite_espacos))
        self.melhor_solucao = self.populacao[0]
        
    def ordena_populacao(self):
        self.populacao = sorted(self.populacao,
                                key = lambda populacao: populacao.nota_avaliacao,
                                reverse = True)
        
    def melhor_individuo(self, individuo):
        if individuo.nota_avaliacao > self.melhor_solucao.nota_avaliacao:
            self.melhor_solucao = individuo
            
    def soma_avaliacoes(self):
        soma = 0
        for individuo in self.populacao:
           soma += individuo.nota_avaliacao
        return soma
    
    def seleciona_pai(self, soma_avaliacao):
        """Seleção dos indivíduos - método Roleta Viciada"""
        pai = -1
        valor_sorteado = random() * soma_avaliacao
        soma = 0
        i = 0
        while i < len(self.populacao) and soma < valor_sorteado:
            soma += self.populacao[i].nota_avaliacao
            pai += 1
            i += 1
        return pai
    
    def visualiza_geracao(self):
        """Função para visualizar os melhores indivíduos de cada geração"""
        melhor = self.populacao[0]
        print("G:%s -> Valor: %s Espaço: %s Cromossomo: %s" % (self.populacao[0].geracao,
                                                               melhor.nota_avaliacao,
                                                               melhor.espaco_usado,
                                                               melhor.cromossomo))
    
    def resolver(self, taxa_mutacao, numero_geracoes, espacos, valores, limite_espacos):
        self.inicializa_populacao(espacos, valores, limite_espacos)
        
        for individuo in self.populacao:
            individuo.avaliacao()
        
        self.ordena_populacao()
        
        self.visualiza_geracao()
        
        for geracao in range(numero_geracoes):
            soma_avaliacao = self.soma_avaliacoes()
            nova_populacao = []
            
            for individuos_gerados in range(0, self.tamanho_populacao, 2):
                pai1 = self.seleciona_pai(soma_avaliacao)
                pai2 = self.seleciona_pai(soma_avaliacao)
                
                filhos = self.populacao[pai1].crossover(self.populacao[pai2])
                
                nova_populacao.append(filhos[0].mutacao(taxa_mutacao))
                nova_populacao.append(filhos[1].mutacao(taxa_mutacao))
            
            self.populacao = list(nova_populacao)
            
            for individuo in self.populacao:
                individuo.avaliacao()
            
            self.ordena_populacao()
            
            self.visualiza_geracao()
            
            melhor = self.populacao[0]
            self.melhor_individuo(melhor)
        
        print("\nMelhor solução -> G: %s Valor: %s Espaço: %s Cromossomo: %s" %
              (self.melhor_solucao.geracao,
               self.melhor_solucao.nota_avaliacao,
               self.melhor_solucao.espaco_usado,
               self.melhor_solucao.cromossomo))
        
        return self.melhor_solucao.cromossomo

#EXECUTOR
if __name__ == '__main__':
    #p1 = Parametro("Iphone 6", 0.0000899, 2199.12)
    lista_parametros = []
    lista_parametros.append(Parametro("Geladeira Dako", 0.751, 999.90))
    lista_parametros.append(Parametro("Iphone 6", 0.0000899, 2911.12))
    lista_parametros.append(Parametro("TV 55' ", 0.400, 4346.99))
    lista_parametros.append(Parametro("TV 50' ", 0.290, 3999.90))
    lista_parametros.append(Parametro("TV 42' ", 0.200, 2999.00))
    lista_parametros.append(Parametro("Notebook Dell", 0.00350, 2499.90))
    lista_parametros.append(Parametro("Ventilador Panasonic", 0.496, 199.90))
    lista_parametros.append(Parametro("Microondas Electrolux", 0.0424, 308.66))
    lista_parametros.append(Parametro("Microondas LG", 0.0544, 429.90))
    lista_parametros.append(Parametro("Microondas Panasonic", 0.0319, 299.29))
    lista_parametros.append(Parametro("Geladeira Brastemp", 0.635, 849.00))
    lista_parametros.append(Parametro("Geladeira Consul", 0.870, 1199.89))
    lista_parametros.append(Parametro("Notebook Lenovo", 0.498, 1999.90))
    lista_parametros.append(Parametro("Notebook Asus", 0.527, 3999.00))

    espacos = []
    valores = []
    nomes = []
    for parametro in lista_parametros:
        espacos.append(parametro.espaco)
        valores.append(parametro.valor)
        nomes.append(parametro.nome)

#    limite = 3
#    tamanho_populacao = 30
#    taxa_mutacao = 0.05
#    numero_geracoes = 100

    ag = AlgoritmoGenetico(tamanho_populacao)
    resultado = ag.resolver(taxa_mutacao, numero_geracoes, espacos, valores, limite)

    for i in range(len(lista_parametros)):
        if resultado[i] == '1':
            print("Nome: %s R$ %s " % (lista_parametros[i].nome,
                                       lista_parametros[i].valor))
# ---------- end ga_2 ----------
python_8 = PythonScript()  # -> out, a
# ---------- python_8: Python ----------
"""
Created on April 18, 2020
    @author: Renato Godoi da Cruz
    email: renatogcruz@hotmail.com
"""

from random import random

class Produto():
    """Cria a classe Produtos"""
    def __init__(self, nome, espaco, valor):
        self.nome = nome
        self.espaco = espaco
        self.valor = valor

#Classe indivíduo I 
#(indivíduos representam as soluções)
#(um conj. de individuos formam uma população)
#(O cromossomo representa uma solução)
#(O indiv. pode ser o próprio cromossomo ou pode conter o cromossomo como atributo [dependendo do caso])
#(gelad. = 0, iphone = 1, notebook = 0, ... (formam o cromossomo '0, 1, 0, ...' que nada mais é do que um conjunto de string")

class Individuo():
    """Cria a classe Indivíduo"""
    def __init__(self, espacos, valores, limite_espacos, geracao=0):
        self.espacos = espacos
        self.valores = valores
        self.limite_espacos = limite_espacos
        self.nota_avaliacao = 0              #somatório dos valores da carga
        self.espaco_usado = 0                #espaço total usado pela carga
        self.geracao = geracao
        self.cromossomo = []
        
        #GERAÇÃO INICIAL este 'for' inicia a primeira população (aleatória)
        for i in range(len(espacos)):        #esse for vai de gero até o espaço que ainda tem para carregar ou não um produto
            if random() < 0.5:               #gera um num. entre 0 e 1 (valores que compõe o cromossomo)
                self.cromossomo.append("0")
            else:
                self.cromossomo.append("1")

    def avaliacao(self):
        """Função para avaliar os indívuos (conjuntos de cromossomos)"""
        nota = 0
        soma_espacos = 0
        for i in range(len(self.cromossomo)):
           if self.cromossomo[i] == '1':
               nota += self.valores[i]
               soma_espacos += self.espacos[i]
        if soma_espacos > self.limite_espacos:
            nota = 1
        self.nota_avaliacao = nota
        self.espaco_usado = soma_espacos

    #CROSSOVER combina pedaços de cromossomos de dois genitores gerando filhos mais aptos
    def crossover(self, outro_individuo):
        """Determina o ponto de crossover"""
        corte = int(round(random()  * len(self.cromossomo)))                     #um número randômico (0 ou 1) vai multiplicar pelo tamanho do cromossomo (round é para arredondar)
        
        filho1 = outro_individuo.cromossomo[0:corte] + self.cromossomo[corte::]  #o filho recebe parte do cromossomo (de 0 até corte) do outro indíviduo
        filho2 = self.cromossomo[0:corte] + outro_individuo.cromossomo[corte::]  #o outro_ind é o individuo2 
        
        filhos = [Individuo(self.espacos, self.valores, self.limite_espacos, self.geracao + 1),
                  Individuo(self.espacos, self.valores, self.limite_espacos, self.geracao + 1)]
        filhos[0].cromossomo = filho1   #filho 1 e 2 na verdade está criando cromossomos
        filhos[1].cromossomo = filho2
        return filhos
    
    def mutacao(self, taxa_mutacao):
        """Função para mutação"""
        #print("Antes %s " % self.cromossomo)
        for i in range(len(self.cromossomo)):
            if random() < taxa_mutacao:
                if self.cromossomo[i] == '1':
                    self.cromossomo[i] = '0'
                else:
                    self.cromossomo[i] = '1'
        #print("Depois %s " % self.cromossomo)
        return self
        
class AlgoritmoGenetico():
    """Classe que implementa o Algoritmo Genético"""
    def __init__(self, tamanho_populacao):
        self.tamanho_populacao = tamanho_populacao
        self.populacao = []
        self.geracao = 0
        self.melhor_solucao = 0
        
    def inicializa_populacao(self, espacos, valores, limite_espacos):
        for i in range(self.tamanho_populacao):
            self.populacao.append(Individuo(espacos, valores, limite_espacos))
        self.melhor_solucao = self.populacao[0]
        
    def ordena_populacao(self):
        self.populacao = sorted(self.populacao,
                                key = lambda populacao: populacao.nota_avaliacao,
                                reverse = True)
        
    def melhor_individuo(self, individuo):
        if individuo.nota_avaliacao > self.melhor_solucao.nota_avaliacao:
            self.melhor_solucao = individuo
            
    def soma_avaliacoes(self):
        soma = 0
        for individuo in self.populacao:
           soma += individuo.nota_avaliacao
        return soma
    
    def seleciona_pai(self, soma_avaliacao):
        """Seleção dos indivíduos - método Roleta Viciada"""
        pai = -1
        valor_sorteado = random() * soma_avaliacao
        soma = 0
        i = 0
        while i < len(self.populacao) and soma < valor_sorteado:
            soma += self.populacao[i].nota_avaliacao
            pai += 1
            i += 1
        return pai
    
    def visualiza_geracao(self):
        """Função para visualizar os melhores indivíduos de cada geração"""
        melhor = self.populacao[0]
        print("G:%s -> Valor: %s Espaço: %s Cromossomo: %s" % (self.populacao[0].geracao,
                                                               melhor.nota_avaliacao,
                                                               melhor.espaco_usado,
                                                               melhor.cromossomo))
    
    def resolver(self, taxa_mutacao, numero_geracoes, espacos, valores, limite_espacos):
        self.inicializa_populacao(espacos, valores, limite_espacos)
        
        for individuo in self.populacao:
            individuo.avaliacao()
        
        self.ordena_populacao()
        
        self.visualiza_geracao()
        
        for geracao in range(numero_geracoes):
            soma_avaliacao = self.soma_avaliacoes()
            nova_populacao = []
            
            for individuos_gerados in range(0, self.tamanho_populacao, 2):
                pai1 = self.seleciona_pai(soma_avaliacao)
                pai2 = self.seleciona_pai(soma_avaliacao)
                
                filhos = self.populacao[pai1].crossover(self.populacao[pai2])
                
                nova_populacao.append(filhos[0].mutacao(taxa_mutacao))
                nova_populacao.append(filhos[1].mutacao(taxa_mutacao))
            
            self.populacao = list(nova_populacao)
            
            for individuo in self.populacao:
                individuo.avaliacao()
            
            self.ordena_populacao()
            
            self.visualiza_geracao()
            
            melhor = self.populacao[0]
            self.melhor_individuo(melhor)
        
        print("\nMelhor solução -> G: %s Valor: %s Espaço: %s Cromossomo: %s" %
              (self.melhor_solucao.geracao,
               self.melhor_solucao.nota_avaliacao,
               self.melhor_solucao.espaco_usado,
               self.melhor_solucao.cromossomo))
        
        return self.melhor_solucao.cromossomo

#EXECUTOR
if __name__ == '__main__':
    #p1 = Produto("Iphone 6", 0.0000899, 2199.12)
    lista_produtos = []
    lista_produtos.append(Produto("Geladeira Dako", 0.751, 999.90))
    lista_produtos.append(Produto("Iphone 6", 0.0000899, 2911.12))
    lista_produtos.append(Produto("TV 55' ", 0.400, 4346.99))
    lista_produtos.append(Produto("TV 50' ", 0.290, 3999.90))
    lista_produtos.append(Produto("TV 42' ", 0.200, 2999.00))
    lista_produtos.append(Produto("Notebook Dell", 0.00350, 2499.90))
    lista_produtos.append(Produto("Ventilador Panasonic", 0.496, 199.90))
    lista_produtos.append(Produto("Microondas Electrolux", 0.0424, 308.66))
    lista_produtos.append(Produto("Microondas LG", 0.0544, 429.90))
    lista_produtos.append(Produto("Microondas Panasonic", 0.0319, 299.29))
    lista_produtos.append(Produto("Geladeira Brastemp", 0.635, 849.00))
    lista_produtos.append(Produto("Geladeira Consul", 0.870, 1199.89))
    lista_produtos.append(Produto("Notebook Lenovo", 0.498, 1999.90))
    lista_produtos.append(Produto("Notebook Asus", 0.527, 3999.00))

    espacos = []
    valores = []
    nomes = []
    for produto in lista_produtos:
        espacos.append(produto.espaco)
        valores.append(produto.valor)
        nomes.append(produto.nome)

    limite = 3
    tamanho_populacao = 30
    taxa_mutacao = 0.05
    numero_geracoes = 100

    ag = AlgoritmoGenetico(tamanho_populacao)
    resultado = ag.resolver(taxa_mutacao, numero_geracoes, espacos, valores, limite)

    for i in range(len(lista_produtos)):
        if resultado[i] == '1':
            print("Nome: %s R$ %s " % (lista_produtos[i].nome,
                                       lista_produtos[i].valor))
# ---------- end python_8 ----------

series_4 = Series(Start=0, Step="2", Count="2")
series_5 = Series(Start=0, Step="6", Count="6")
series_6 = Series(Start=0, Step=2, Count="4")
entwine_2 = Entwine(Branch00=series_4, Branch01=series_5, Branch02=series_6, FlattenInputs=True)
panel_13 = Panel(entwine_2)
bang_3 = ExplodeTree(Data=entwine_2)  # -> Branch0, Branch1, Branch2
python_9 = PythonScript(inputData=entwine_2, runIt=Toggle(False))  # -> output; inputs inputData: tree, runIt: Boolean
# ---------- python_9: Python ----------
import Grasshopper

def addOutputParam(outputIndex):
    
    param = Grasshopper.Kernel.Parameters.Param_String()
    outputName = "output_%s" % branchIndex
    param.NickName = outputName
    param.Name = outputName
    param.Description = "description of output parameter %s" % outputName
    param.Access = Grasshopper.Kernel.GH_ParamAccess.list
    param.AddVolatileDataList(inputData.Paths[outputIndex], inputData.Branches[outputIndex])
    outputIndex = ghenv.Component.Params.Output.Count
    ghenv.Component.Params.RegisterOutputParam(param, outputIndex)


if _runIt:
    for branchIndex in range(inputData.BranchCount):
        if branchIndex == 0:
            # remove all output parameters but "output"
            numberOfOutputs = ghenv.Component.Params.Output.Count
            ghenv.Component.Params.Output.RemoveRange(1, numberOfOutputs-1)
        
        addOutputParam(branchIndex)

else:
    ghenv.Component.Params.OnParametersChanged()
    # remove all output parameters but "output"
    numberOfOutputs = ghenv.Component.Params.Output.Count
    if numberOfOutputs > 1:
        ghenv.Component.Params.Output.RemoveRange(1, numberOfOutputs-1)

ghenv.Component.Params.OnParametersChanged()
# ---------- end python_9 ----------
python_10 = PythonScript(inputData=entwine_2, runIt=Toggle(True))  # -> output, output_0, output_1, output_2; inputs inputData: tree, runIt: Boolean; same code as python_9
panel_14 = Panel(python_10.output_0)

param_viewer_3 = ParamViewer(entwine_2)
print = Panel(ga_2.out)
ghpython_script_9 = GhPythonScript()  # -> out, graft(a), b
# ---------- ghpython_script_9: Python ----------
__author__ = "Renato"
__version__ = "2020.08.29"

import rhinoscriptsyntax as rs

aa = [0, 2, 5, 8, 6, 8]
bb = []

for i in range(len(aa)):
    bb.append([])


a = aa
b = bb
# ---------- end ghpython_script_9 ----------
# transformando uma lista de números em um ramo de uma árvore explodível
ghpython_script_10 = GhPythonScript()  # -> out, a
# ---------- ghpython_script_10: Python ----------
__author__ = "Renato"
__version__ = "2020.08.29"

import rhinoscriptsyntax as rs

a = [0, 2, 5]
# ---------- end ghpython_script_10 ----------
bang_4 = ExplodeTree(Data=ghpython_script_9.a)  # -> Branch0, Branch1, Branch2, Branch3, Branch4, Branch5
python_11 = PythonScript(inputData=ghpython_script_10.a, runIt=Toggle(True))  # -> output, output_0; inputs inputData: tree, runIt: Boolean; same code as python_9
panel_15 = Panel(ghpython_script_9.a)
