# Grasshopper definition GA_passo_a_passo.gh (Grasshopper 0.9.76)
# plug-ins: Python Interpreter

# refazer o trecho do crossover separadamente.
python = PythonScript()  # -> out, a
# ---------- python: Python ----------
"""
Created on April 18, 2020
    @author: Renato Godoi da Cruz
    email: renatogcruz@hotmail.com
"""

from random import random

class Produto():
    """Creates the product class"""
    def __init__(self, nome, espaco, valor):
        self.nome = nome
        self.espaco = espaco
        self.valor = valor

#Classe indivíduo I 
#(indivíduos representam as soluções)
#(um conj. de individuos formam uma população)
#(O cromossomo representa uma solução)
#(O indiv. pode ser o próprio cromossomo ou pode conter o cromossomo como atributo [dependendo do caso])
#(gelad. = 0, iphone = 1, notebook = 0, ... (formam o cromossomo '0, 1, 0, ...' que nada mais é do que um conjunto de string")

class Individuo():
    def __init__(self, espacos, valores, limite_espacos, geracao=0):
        self.espacos = espacos
        self.valores = valores
        self.limite_espacos = limite_espacos
        self.nota_avaliacao = 0 #somátoria dos valores da carga
        self.espaco_usado = 0   #espaço total usado pela carga
        self.geracao = geracao
        self.cromossomo = [] #aqui vai estar contida as soluções para o nosso problema. Para ver o desempenho do individuo teremos que acessar aqui.
        
        #GERAÇÃO INICIAL este for inicia a primeira população (aleatória)
        for i in range(len(espacos)): #esse for vai de gero até o espaço que ainda tem para carregar ou não um produto
            if random() < 0.5: #gera um num. entre 0 e 1 (valores que compõe o cromossomo)
                self.cromossomo.append("0")
            else:
                self.cromossomo.append("1")
    #AVALIAR A POPULAÇÃO
    def avaliacao(self):
        """Função para availiar a população"""
        nota = 0
        soma_espaco = 0
        for i in range(len(self.cromossomo)): #vai percorrer cada um dos itens
            if self.cromossomo[i] == "1":     #1  = vai levar
                nota += self.valores[i]       #está somando os valores dos produtos que vão ser levados 
                soma_espaco += self.espacos[i]#está somando os espacços dos objetos que serão carregados
        if soma_espaco > self.limite_espacos: #se a soma dos espaços dos produtos superarem o limite do espaço vamos rebaixar a nota para 1
            nota = 1                          #punição porque extrapolou o limite de espaço
        self.nota_avalicao = nota
        self.espaco_usado = soma_espaco

    #CROSSOVER combina pedaços de cromossomos de dois genitores gerando filhos mais aptos
    def crossover(self, outro_individuo): #O PROBLEMA ESTÁ NO CROMOSSOMO###############
        """Operação de crossover de um ponto"""
        corte = int(round(random() * len(self.cromossomo))) #um número randomico (0 ou 1) vai multiplicar pelo tamanho do cromossomo (round é para arredondar)

        filho1 = outro_individuo.cromossomo[0:corte] + self.cromossomo[corte::] #o filho recebe parte do cromossomo (de 0 até corte) do outro indíviduo
        filho2 = self.cromossomo[0:corte] + outro_individuo.cromossomo[corte::] #o outro_ind é o individuo2 
        
        filhos = [Individuo(self.espacos, self.valores, self.limite_espacos, self.geracao + 1),
                  Individuo(self.espacos, self.valores, self.limite_espacos, self.geracao + 1)]
        filhos[0].cromossomo = filho1 #filho 1 e 2 na verdade está criando cromossomos
        filhos[1].cromossomo = filho2
        return filhos



#EXECUTOR
if __name__ == '__main__':
    #p1 = Produto("Iphone 6", 0.0000899, 2199.12)
    lista_produtos = []
    lista_produtos.append(Produto("Geladeira Dako", 0.751, 999.90))
    lista_produtos.append(Produto("Iphone 6", 0.0000899, 2911.12))
    lista_produtos.append(Produto("TV 55' ", 0.400, 4346.99))
    lista_produtos.append(Produto("TV 50' ", 0.290, 3999.90))
    lista_produtos.append(Produto("TV 42' ", 0.200, 2999.00))
    lista_produtos.append(Produto("Notebook Dell", 0.00350, 2499.90))
    lista_produtos.append(Produto("Ventilador Panasonic", 0.496, 199.90))
    lista_produtos.append(Produto("Microondas Electrolux", 0.0424, 308.66))
    lista_produtos.append(Produto("Microondas LG", 0.0544, 429.90))
    lista_produtos.append(Produto("Microondas Panasonic", 0.0319, 299.29))
    lista_produtos.append(Produto("Geladeira Brastemp", 0.635, 849.00))
    lista_produtos.append(Produto("Geladeira Consul", 0.870, 1199.89))
    lista_produtos.append(Produto("Notebook Lenovo", 0.498, 1999.90))
    lista_produtos.append(Produto("Notebook Asus", 0.527, 3999.00))
    #for produto in lista_produtos:
    #    print(produto.nome)
    
    espacos = []
    valores = []
    nomes = []
    for produto in lista_produtos:
        espacos.append(produto.espaco)
        valores.append(produto.valor)
        nomes.append(produto.nome)
    limite = 3
    
    individuo1 = Individuo(espacos, valores, limite)
    print("\nIndivíduo 1")
    for i in range(len(lista_produtos)):
        if individuo1.cromossomo[i] == '1':
            print("Nome: %s R$ %s " % (lista_produtos[i].nome, lista_produtos[i].valor))
    individuo1.avaliacao()
    print("Nota = %s" % individuo1.nota_avaliacao)
    print("Espaço usado = %s" % individuo1.espaco_usado)
    
    individuo2 = Individuo(espacos, valores, limite)
    print("\nIndivíduo 2")
    for i in range(len(lista_produtos)):
        if individuo2.cromossomo[i] == '1':
            print("Nome: %s R$ %s " % (lista_produtos[i].nome, lista_produtos[i].valor))
    individuo2.avaliacao()
    print("Nota = %s" % individuo2.nota_avaliacao)
    print("Espaço usado = %s" % individuo2.espaco_usado)
    
    individuo1.crossover(individuo2)
# ---------- end python ----------
python_2 = PythonScript()  # -> out, a
# ---------- python_2: Python ----------
from random import random

class Produto():
    def __init__(self, nome, espaco, valor):
        self.nome = nome
        self.espaco = espaco
        self.valor = valor
        
class Individuo():
    def __init__(self, espacos, valores, limite_espacos, geracao=0):
        self.espacos = espacos
        self.valores = valores
        self.limite_espacos = limite_espacos
        self.nota_avaliacao = 0
        self.espaco_usado = 0
        self.geracao = geracao
        self.cromossomo = []
        
        for i in range(len(espacos)):
            if random() < 0.5:
                self.cromossomo.append("0")
            else:
                self.cromossomo.append("1")
                
    def avaliacao(self):
        nota = 0
        soma_espacos = 0
        for i in range(len(self.cromossomo)):
           if self.cromossomo[i] == '1':
               nota += self.valores[i]
               soma_espacos += self.espacos[i]
        if soma_espacos > self.limite_espacos:
            nota = 1
        self.nota_avaliacao = nota
        self.espaco_usado = soma_espacos
        
    def crossover(self, outro_individuo):
        corte = int(round(random()  * len(self.cromossomo)))
        
        filho1 = outro_individuo.cromossomo[0:corte] + self.cromossomo[corte::]
        filho2 = self.cromossomo[0:corte] + outro_individuo.cromossomo[corte::]
        
        filhos = [Individuo(self.espacos, self.valores, self.limite_espacos, self.geracao + 1),
                  Individuo(self.espacos, self.valores, self.limite_espacos, self.geracao + 1)]
        filhos[0].cromossomo = filho1
        filhos[1].cromossomo = filho2
        return filhos
        
if __name__ == '__main__':
    #p1 = Produto("Iphone 6", 0.0000899, 2199.12)
    lista_produtos = []
    lista_produtos.append(Produto("Geladeira Dako", 0.751, 999.90))
    lista_produtos.append(Produto("Iphone 6", 0.0000899, 2911.12))
    lista_produtos.append(Produto("TV 55' ", 0.400, 4346.99))
    lista_produtos.append(Produto("TV 50' ", 0.290, 3999.90))
    lista_produtos.append(Produto("TV 42' ", 0.200, 2999.00))
    lista_produtos.append(Produto("Notebook Dell", 0.00350, 2499.90))
    lista_produtos.append(Produto("Ventilador Panasonic", 0.496, 199.90))
    lista_produtos.append(Produto("Microondas Electrolux", 0.0424, 308.66))
    lista_produtos.append(Produto("Microondas LG", 0.0544, 429.90))
    lista_produtos.append(Produto("Microondas Panasonic", 0.0319, 299.29))
    lista_produtos.append(Produto("Geladeira Brastemp", 0.635, 849.00))
    lista_produtos.append(Produto("Geladeira Consul", 0.870, 1199.89))
    lista_produtos.append(Produto("Notebook Lenovo", 0.498, 1999.90))
    lista_produtos.append(Produto("Notebook Asus", 0.527, 3999.00))
    #for produto in lista_produtos:
    #    print(produto.nome)
    
    espacos = []
    valores = []
    nomes = []
    for produto in lista_produtos:
        espacos.append(produto.espaco)
        valores.append(produto.valor)
        nomes.append(produto.nome)
    limite = 3
    
    individuo1 = Individuo(espacos, valores, limite)
    print("\nIndivíduo 1")
    for i in range(len(lista_produtos)):
        if individuo1.cromossomo[i] == '1':
            print("Nome: %s R$ %s " % (lista_produtos[i].nome, lista_produtos[i].valor))
    individuo1.avaliacao()
    print("Nota = %s" % individuo1.nota_avaliacao)
    print("Espaço usado = %s" % individuo1.espaco_usado)
    
    individuo2 = Individuo(espacos, valores, limite)
    print("\nIndivíduo 2")
    for i in range(len(lista_produtos)):
        if individuo2.cromossomo[i] == '1':
            print("Nome: %s R$ %s " % (lista_produtos[i].nome, lista_produtos[i].valor))
    individuo2.avaliacao()
    print("Nota = %s" % individuo2.nota_avaliacao)
    print("Espaço usado = %s" % individuo2.espaco_usado)
    
    individuo1.crossover(individuo2)
# ---------- end python_2 ----------
print = Panel(python_2.out)
print_2 = Panel(python.out)
